# Grasshopper definition line_model.ghx (Grasshopper 1.0.8)
# plug-ins: Pufferfish, Human

range = Range(Domain=Domain(0, 1), Steps="3")
range_2 = Range(Domain=Domain(0, 1), Steps="3")
range_3 = Range(Domain=Domain(0, 1), Steps="3")
range_4 = Range(Domain=Domain(0, 1), Steps="3")
graph_mapper = GraphMapper(
    range_2,
    x0=0,
    x1=1,
    y0=0,
    y1=1,
    container_name="Bezier",
    cpx=[0, 0.415862143, 0.940971911, 1],
    cpy=[0, 0.0582934618, 0.3582203984, 1])
graph_mapper_2 = GraphMapper(
    range_3,
    x0=0,
    x1=1,
    y0=0,
    y1=1,
    container_name="Bezier",
    cpx=[0, 0.415862143, 0.940971911, 1],
    cpy=[0, 0.0582934618, 0.3582203984, 1])
graph_mapper_3 = GraphMapper(
    range,
    x0=0,
    x1=1,
    y0=0,
    y1=1,
    container_name="Bezier",
    cpx=[0, 0.415862143, 0.940971911, 1],
    cpy=[0, 0.0582934618, 0.3582203984, 1])
graph_mapper_4 = GraphMapper(
    range_4,
    x0=0,
    x1=1,
    y0=0,
    y1=1,
    container_name="Bezier",
    cpx=[0, 0.415862143, 0.8706001639, 1],
    cpy=[0, 0.0582934618, 0.2888201475, 1])

entwine = Entwine(Branch00=graph_mapper_4, Branch01=graph_mapper_2, Branch02=graph_mapper, Branch03=graph_mapper_3, FlattenInputs=True)  # -> simplify(Result)
panel = Panel("modify points")
# half the beam width?
number_slider = Slider(0.05, range=0..0.1)
number_slider_2 = Slider(0.12, range=0..1)  # disabled
number_slider_3 = Slider(0.1, range=0..0.1)  # disabled

brep = Brep([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])

# ----
# create and manipulate graph
point = Point([Point(2.7, 7.810000534, 0), Point(0.3, 1.810000534, 0), Point(2.7, 1.810000534, 0), Point(0.3, 7.810000534, 0)])

point_2 = Point(point)

python_3_script = Python3Script(roof_breps=brep, supports=point_2, z_steps=entwine)  # -> out, ridges_tree, all_edges, graph, all_nodes, node_keys; inputs roof_breps: list of Brep, supports: list of Point3d, z_steps: tree of Double
# ---------- python_3_script: Python ----------
import os
import sys
from compas_rhino import unload_modules
import compas
compas.PRECISION = ".3f"

gh_dir = os.path.dirname(ghenv.Component.OnPingDocument().FilePath)
sys.path.append(gh_dir)

import tree_builder
import nodegraph
import importlib

importlib.reload(nodegraph)
importlib.reload(tree_builder)


from tree_builder import build_tree_graph_from_breps
from Grasshopper import DataTree
from Grasshopper.Kernel.Data import GH_Path

# lines_tree will be our output
lines_tree = DataTree[object]()
z_tree = []
# 1. Iterate using the Branch count
for i in range(z_steps.BranchCount):
    branch = list(z_steps.Branch(i)) 
    z_tree.append(branch)

# CONSTANTS #
div_x = 3
div_y = 3
num_levels = 3

inset_edge = 0.5
inset_interior = 0.5

# Build the graph (all logic is in tree_builder.py)
ng = build_tree_graph_from_breps(
    supports=supports,
    input_breps=roof_breps,
    div_x=div_x if div_x else 8,
    div_y=div_y if div_y else 6,
    num_levels=num_levels if num_levels else 4,
    z_steps=z_tree,
    inset_edge=inset_edge if inset_edge else 0.5,
    inset_interior=inset_interior if inset_interior else 0.4,
    reach_tol=0.05,
    debug=True
)

# Outputs
all_edges = ng.edge_lines()
graph = ng
all_nodes = ng.node_points()
node_keys = list(ng.nodes())
# ---------- end python_3_script ----------
compas_draw = COMPASDraw(cg=python_3_script.all_nodes)  # -> rg
#   port cg: The COMPAS geometry or datastructure to be drawn.
#   port rg: The Rhino geometry object.
# ---------- compas_draw: Python ----------
# r: compas>=2.14.1
"""
Draws COMPAS geometry in Grasshopper.
"""

from typing import Any

import Grasshopper

from compas.scene import SceneObject


class CompasToRhinoGeometry(Grasshopper.Kernel.GH_ScriptInstance):
    def RunScript(self, cg):
        if not cg:
            return None

        return SceneObject(item=cg).draw()
# ---------- end compas_draw ----------
compas_draw_2 = COMPASDraw(cg=python_3_script.all_edges)  # -> rg; same code as compas_draw

# ----
# transform points
brep_2 = Brep(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)
python_3_script_2 = Python3Script(graph=python_3_script.graph, repellors=brep_2)  # -> out, edges, nodes, node_graph; inputs repellors: list of Brep
# ---------- python_3_script_2: Python ----------
import os, sys, importlib
gh_dir = os.path.dirname(ghenv.Component.OnPingDocument().FilePath)
if gh_dir not in sys.path:
    sys.path.insert(0, gh_dir)

### -----------------------------
## IMPORT
### -----------------------------
import nodegraph

importlib.reload(nodegraph)

from copy import deepcopy
from compas.geometry import Vector, Line, Point, centroid_points

ng = deepcopy(graph)



ng, results = ng.move_nodes_from_geometry(
    repellors,               # Mix of anything
    max_distance = 2.0,
    strength = 2,
    falloff = "smooth"
)

# Outputs
node_graph = ng
edges = ng.edge_lines()
nodes = ng.node_points()
moved_pts = [r['new'] for r in results.values()]
# ---------- end python_3_script_2 ----------

# ----
# classify edges
python_3_script_3 = Python3Script(graph=python_3_script_2.node_graph)  # -> out, primary_lines, secondary_lines, graph_out
# ---------- python_3_script_3: Python ----------
import os, sys, importlib

gh_dir = os.path.dirname(ghenv.Component.OnPingDocument().FilePath)
if gh_dir not in sys.path:
    sys.path.insert(0, gh_dir)

import edge_classifier
importlib.reload(edge_classifier)
from edge_classifier import classify_edges_by_support_direction

primary_lines, secondary_lines, data = classify_edges_by_support_direction(graph, debug=True)

# output 
graph_out = graph
# ---------- end python_3_script_3 ----------

# ----
# preview graph
number_slider_4 = Slider(0.1, range=-0.5..0.5)
compas_draw_3 = COMPASDraw(cg=python_3_script_2.edges)  # -> rg; same code as compas_draw
compas_draw_4 = COMPASDraw(cg=python_3_script_2.nodes)  # -> rg; same code as compas_draw
dot_display = DotDisplay(Point=compas_draw_4, Colour=ColourSwatch(SwatchColor=RGB(128, 128, 128)), Size=number_slider_4)

custom_preview_lineweights = CustomPreviewLineweights(
    Geometry=compas_draw_3,
    Shader=ColourSwatch(SwatchColor=RGB(144, 209, 232)),
    Thickness=Slider(4, range=0..10),
    Absolute=False)

# ----
# shifting and add shoes
py3 = Python3Script(graph=python_3_script_3.graph_out)  # -> out, nodegraph, a
# ---------- py3: Python ----------
import os, sys, importlib

gh_dir = os.path.dirname(ghenv.Component.OnPingDocument().FilePath)
if gh_dir not in sys.path:
    sys.path.insert(0, gh_dir)

import edge_classifier
import reciprocal
import line_constraints

importlib.reload(edge_classifier)
importlib.reload(reciprocal)
importlib.reload(line_constraints)

# 1) classify
primary_lines, secondary_lines, data = edge_classifier.classify_edges_by_support_direction(graph, debug=True)

# 2) build explicit primary edge list from classification data
primary_edges = [d["edge"] for d in data if d.get("type") in ("primary", "double")]

# 3) reciprocal only those edges
res_ortho = reciprocal.reciprocal_width_from_subgraph(
    graph,                      # or your subgraph if that's what you want to modify
    target_edges=primary_edges, # key change
    engage_len=0.11,
    tol=0.1,
    rotation_sign=-1,
    min_degree=3,
    iterations=5,
    debug=True,
)

nodegraph = res_ortho["graph"]
a = res_ortho["shifted_lines"]
# ---------- end py3 ----------
draw = COMPASDraw(cg=py3.a)  # -> rg; same code as compas_draw
python_3_script_4 = Python3Script(graph=py3.nodegraph)  # -> out, graph_out, shoe_lines
# ---------- python_3_script_4: Python ----------
import os, sys, importlib
gh_dir = os.path.dirname(ghenv.Component.OnPingDocument().FilePath)
if gh_dir not in sys.path:
    sys.path.insert(0, gh_dir)


import leaf_solver
importlib.reload(leaf_solver)
from leaf_solver import create_shoes_from_graph
from copy import deepcopy



ng = deepcopy(graph)
result = create_shoes_from_graph(ng, extension_length = 0.20)

shoe_lines = result["shoe_lines"]
graph_out = ng
# ---------- end python_3_script_4 ----------
draw_2 = COMPASDraw(cg=python_3_script_4.shoe_lines)  # -> rg; same code as compas_draw

offset_surface = OffsetSurface(Surface=brep, Distance=Slider(0.06, range=0..0.1), BothSides=0, CreateSolid=True)
ct_beam = CTBeam(centerline=compas_draw_3, width=Slider(0.1, range=0..0.1), height=Slider(0.12, range=0..1))  # -> Beam, Blank; inputs centerline: list, z_vector: list of Vector3d, width: list of Double, height: list of Double, category: list of String, updateRefObj: Boolean
#   port centerline: Referenced curve or line, Guid of curve or line in the active Rhino document.
#   port z_vector: Vector defining the orientation of the cross-section (corresponds to the height dimension). If None, a default will be taken.
#   port width: Width of the cross-section (usually the smaller dimension).
#   port height: Height of the cross-section (usually the larger dimension).
#   port category: Category of a beam.
#   port updateRefObj: (optional) If True, the attributes in the referenced object will be updated/overwritten with the new values given here.
#   port Beam: Beam object(s).
#   port Blank: Shape of the beam's blank.
# ---------- ct_beam: Python ----------
# r: compas_timber==1.0.5
"""Creates a Beam from a LineCurve."""

# flake8: noqa
import Grasshopper
import Rhino
import rhinoscriptsyntax as rs
import System
from compas.scene import Scene
from compas_rhino.conversions import line_to_compas
from compas_rhino.conversions import vector_to_compas

from compas_timber.elements import Beam as CTBeam
from compas_timber.ghpython.rhino_object_name_attributes import update_rhobj_attributes_name
from compas_timber.ghpython.ghcomponent_helpers import list_input_valid_cpython


class Beam_fromCurve(Grasshopper.Kernel.GH_ScriptInstance):
    def RunScript(self,
            centerline: System.Collections.Generic.List[object],
            z_vector: System.Collections.Generic.List[Rhino.Geometry.Vector3d],
            width: System.Collections.Generic.List[float],
            height: System.Collections.Generic.List[float],
            category: System.Collections.Generic.List[str],
            updateRefObj: bool):
        # minimum inputs required
        if not list_input_valid_cpython(ghenv, centerline, "Centerline"):
            return
        if not width:
            length = self._get_centerline_length(centerline)
            width = [length / 20]
        if not height:
            length = self._get_centerline_length(centerline)
            height = [length / 10]

        # reformat unset parameters for consistency
        if not z_vector:
            z_vector = [None]
        if not category:
            category = [None]

        beams = []
        blanks = []
        scene = Scene()

        if centerline and height and width:
            # check list lengths for consistency
            N = len(centerline)
            if len(z_vector) not in (0, 1, N):
                ghenv.Component.AddRuntimeMessage(
                    Grasshopper.Kernel.GH_RuntimeMessageLevel.Error, " In 'ZVector' I need either none, one or the same number of inputs as the Crv parameter."
                )
            if len(width) not in (1, N):
                ghenv.Component.AddRuntimeMessage(Grasshopper.Kernel.GH_RuntimeMessageLevel.Error, " In 'W' I need either one or the same number of inputs as the Crv parameter.")
            if len(height) not in (1, N):
                ghenv.Component.AddRuntimeMessage(Grasshopper.Kernel.GH_RuntimeMessageLevel.Error, " In 'H' I need either one or the same number of inputs as the Crv parameter.")
            if len(category) not in (0, 1, N):
                ghenv.Component.AddRuntimeMessage(
                    Grasshopper.Kernel.GH_RuntimeMessageLevel.Error, " In 'Category' I need either none, one or the same number of inputs as the Crv parameter."
                )

            # duplicate data if None or single value
            if len(z_vector) != N:
                z_vector = [z_vector[0] for _ in range(N)]
            if len(width) != N:
                width = [width[0] for _ in range(N)]
            if len(height) != N:
                height = [height[0] for _ in range(N)]
            if len(category) != N:
                category = [category[0] for _ in range(N)]

            for line, z, w, h, c in zip(centerline, z_vector, width, height, category):
                guid, geometry = self._get_guid_and_geometry(line)
                rhino_line = rs.coerceline(geometry)
                line = line_to_compas(rhino_line)

                z = vector_to_compas(z) if z else None
                beam = CTBeam.from_centerline(centerline=line, width=w, height=h, z_vector=z)
                beam.attributes["rhino_guid"] = str(guid) if guid else None
                beam.attributes["category"] = c
                if updateRefObj and guid:
                    update_rhobj_attributes_name(guid, "width", str(w))
                    update_rhobj_attributes_name(guid, "height", str(h))
                    update_rhobj_attributes_name(guid, "zvector", str(list(beam.frame.zaxis)))
                    update_rhobj_attributes_name(guid, "category", c)

                beams.append(beam)
                scene.add(beam.blank)

        blanks = scene.draw()

        return beams, blanks

    def _get_guid_and_geometry(self, line):
        # internalized curves and GH geometry will not have persistent GUIDs, referenced Rhino objects will
        # type hint on the input has to be 'ghdoc' for this to work
        guid = None
        geometry = line
        rhino_obj = Rhino.RhinoDoc.ActiveDoc.Objects.FindId(line)
        if rhino_obj:
            guid = line
            geometry = rhino_obj.Geometry
        return guid, geometry

    def _get_centerline_length(self, centerline):
        centerline_length = []
        for i in centerline:
            centerline_length.append(rs.CurveLength(i))
        if centerline_length:
            length_average = sum(centerline_length) / len(centerline_length)
        else:
            length_average = 1
        return length_average
# ---------- end ct_beam ----------
volume = Volume(Geometry=ct_beam.Blank)  # -> Volume, Centroid
mass_addition = MassAddition(Input=volume.Volume)  # -> Result, PartialResults
relay = Relay([ct_beam.Blank, offset_surface])
custom_preview = CustomPreview(Geometry=relay, Material=ColourSwatch(SwatchColor=RGB(219, 206, 167)))
panel_2 = Panel(mass_addition.Result)

# ----
# Classfiy Edges
# op1 rotate
# op2 choose 1 to be primary and shift others
# op3 use design, cut diagonal
python_3_script_5 = Python3Script(graph=python_3_script_4.graph_out)  # -> out, primary_lines, secondary_lines, tertiary_lines, nodes_pts, nodes_idx, chosen_edge_lines, graph_out
# ---------- python_3_script_5: Python ----------
import os, sys, importlib

gh_dir = os.path.dirname(ghenv.Component.OnPingDocument().FilePath)
if gh_dir not in sys.path:
    sys.path.insert(0, gh_dir)

import edge_classifier
importlib.reload(edge_classifier)
from edge_classifier import classify_edges_by_support_direction, create_subgraphs
from compas.geometry import Line

primary_lines, secondary_lines, tertiary_lines, data, node_edge_report = classify_edges_by_support_direction(
    graph,
    return_tertiary=True,
    return_node_edge_report=True
)
edge_to_idx = {}
for i, (u, v) in enumerate(graph.edges()):
    edge_to_idx[frozenset((u, v))] = i

# outputs debug
nodes_pts = []       # points
nodes_idx = []       # node ids 
chosen_edge_lines = []  # choosen edge as Line


for r in node_edge_report:
    n = r["node"]
    e = r["seed_edge"]  

    # node point + node id
    p = graph.node_attribute(n, "point")
    nodes_pts.append(p)
    nodes_idx.append(n)

    # chosen edge as line + edge idx
    u, v = e
    pu = graph.node_attribute(u, "point")
    pv = graph.node_attribute(v, "point")
    chosen_edge_lines.append(Line(pu, pv) if (pu and pv) else None)

# output 
graph_out = graph
# ---------- end python_3_script_5 ----------
draw_3 = COMPASDraw(cg=python_3_script_5.primary_lines)  # -> rg; same code as compas_draw
draw_4 = COMPASDraw(cg=python_3_script_5.secondary_lines)  # -> rg; same code as compas_draw
draw_5 = COMPASDraw(cg=python_3_script_5.tertiary_lines)  # -> rg; same code as compas_draw
draw_6 = COMPASDraw(cg=python_3_script_5.nodes_pts)  # -> rg; same code as compas_draw
draw_7 = COMPASDraw(cg=python_3_script_5.chosen_edge_lines)  # -> rg; same code as compas_draw
custom_preview_lineweights_2 = CustomPreviewLineweights(Geometry=draw_3, Shader=ColourSwatch(SwatchColor=RGB(137, 50, 143)), Thickness="8", Absolute=False)
custom_preview_lineweights_3 = CustomPreviewLineweights(Geometry=draw_4, Shader=ColourSwatch(SwatchColor=RGB(50, 143, 103)), Thickness="6", Absolute=False)
custom_preview_lineweights_4 = CustomPreviewLineweights(Geometry=draw_5, Shader=ColourSwatch(SwatchColor=RGB(218, 157, 103)), Thickness="6", Absolute=False)

draw_8 = COMPASDraw(cg=python_3_script_3.secondary_lines)  # -> rg; same code as compas_draw
draw_9 = COMPASDraw(cg=python_3_script_3.primary_lines)  # -> rg; same code as compas_draw
custom_preview_lineweights_5 = CustomPreviewLineweights(Geometry=draw_9, Shader=ColourSwatch(SwatchColor=RGB(137, 50, 143)), Thickness="8", Absolute=False)
custom_preview_lineweights_6 = CustomPreviewLineweights(Geometry=draw_8, Shader=ColourSwatch(SwatchColor=RGB(50, 143, 103)), Thickness="6", Absolute=False)

swatch = ColourSwatch(SwatchColor=RGB(51, 56, 66))
text_tag = TextTag(Location=draw_6, Text=python_3_script_5.nodes_idx, Colour=swatch)
dot_display_2 = DotDisplay(Point=draw_6, Colour=swatch, Size=Slider(0.1, range=0..0.1))

py3_2 = Python3Script(ng=python_3_script_5.graph_out, z_shift=number_slider)  # -> out, a, b, c, d, e, f, graph_out, edges, shifted; inputs z_shift: Double
# ---------- py3_2: Python ----------
import os, sys, importlib
from copy import deepcopy

gh_dir = os.path.dirname(ghenv.Component.OnPingDocument().FilePath)
if gh_dir not in sys.path:
    sys.path.insert(0, gh_dir)

import edge_classifier
import reciprocal
import line_constraints

importlib.reload(edge_classifier)
importlib.reload(reciprocal)
importlib.reload(line_constraints)

graph = deepcopy(ng)

# -----------------------------
# controls
# -----------------------------
sign_primary = +1
sign_secondary = -1
engage_len = 0.11
tol = 0.1
iters = 5


# -----------------------------
# 2) reciprocal primary
# -----------------------------
res_primary = reciprocal.reciprocal_width_from_subgraph(
    graph,
    target_hierarchies=("primary", "double"),
    engage_len=engage_len,
    tol=tol,
    rotation_sign=sign_primary,
    min_degree=3,
    iterations=iters,
    debug=False,
    straight_angle_threshold_deg=180.0
)
g = res_primary["graph"]

# -----------------------------
# 3) regenerate secondary + tertiary (level 1 up)
# -----------------------------
line_constraints.regenerate_edges(
    g,
    target_hierarchy="secondary",
    move_node_level=1,
    host_hierarchy="primary",
    choose="up",
    z_offset = z_shift,
    write_attribute=True,
    debug=False
)

line_constraints.regenerate_edges(
    g,
    target_hierarchy="tertiary",
    move_node_level=1,
    host_hierarchy="primary",
    choose="up",
    z_offset = z_shift,
    write_attribute=True,
    debug=False
)

# -----------------------------
# 4) reciprocal secondary
# -----------------------------
res_secondary = reciprocal.reciprocal_width_from_subgraph(
    g,
    target_hierarchies="secondary",
    engage_len=engage_len,
    tol=tol,
    rotation_sign=sign_secondary,
    min_degree=3,
    iterations=iters,
    debug=False,
    straight_angle_threshold_deg=180.0
)
g = res_secondary["graph"]

# -----------------------------
# 5) regenerate tertiary (level 0 up)
# -----------------------------
line_constraints.regenerate_edges(
    g,
    target_hierarchy="tertiary",
    move_node_level=0,
    host_hierarchy="secondary",
    choose="up",
    z_offset = z_shift,
    write_attribute=True,
    debug=False
)

line_constraints.regenerate_edges(
    g,
    target_hierarchy="tertiary",
    move_node_level=0,
    host_hierarchy="primary",
    choose="up",
    z_offset = z_shift,
    write_attribute=True,
    debug=False
)

terd = line_constraints.regenerate_edges(
    g,
    target_hierarchy="tertiary",
    target_level_pair = (0,1),
    move_node_level=0,
    host_hierarchy="secondary",
    choose="down",
    z_offset = z_shift,
    write_attribute=True,
    debug=True
)

print(terd["info"])
# outputs
graph_out = g
edges = g.edge_lines()  # node-point-based lines
a = res_primary["shifted_lines"]
b = res_secondary["shifted_lines"]
c = terd["shifted_lines"]

shifted = []
for e in g.edges():
    shifted.append(g.edge_attribute(e, "shifted_lines"))
# ---------- end py3_2 ----------
draw_10 = COMPASDraw(cg=py3_2.a)  # -> rg; same code as compas_draw
draw_11 = COMPASDraw(cg=py3_2.b)  # -> rg; same code as compas_draw
draw_12 = COMPASDraw(cg=py3_2.d)  # -> rg; same code as compas_draw
draw_13 = COMPASDraw(cg=py3_2.f)  # -> rg; same code as compas_draw
draw_14 = COMPASDraw(cg=py3_2.c)  # -> rg; same code as compas_draw
draw_15 = COMPASDraw(cg=py3_2.shifted)  # -> rg; same code as compas_draw

# ----
# previous version - ignore
py3_3 = Python3Script(ng=python_3_script_5.graph_out)  # -> out, a, b, c, d, e, f, graph_out, edges, shifted; disabled
# ---------- py3_3: Python ----------
import os, sys, importlib

gh_dir = os.path.dirname(ghenv.Component.OnPingDocument().FilePath)
if gh_dir not in sys.path:
    sys.path.insert(0, gh_dir)

import edge_classifier
import reciprocal
import line_constraints

from compas.geometry import Line, Point

importlib.reload(edge_classifier)
importlib.reload(reciprocal)
importlib.reload(line_constraints)

from copy import deepcopy

graph = deepcopy(ng)


# -----------------------------
# controls
# -----------------------------
sign_primary = +1
sign_secondary = -1
engage_len = 0.11
tol = 0.1
iters = 5

# -----------------------------
# helpers
# -----------------------------
def _dist(p, q):
    return ((p.x - q.x)**2 + (p.y - q.y)**2 + (p.z - q.z)**2) ** 0.5

def _edge_line(g, e):
    # prefer shifted, then committed line, then fallback from node points
    ln = g.edge_attribute(e, "shifted_lines")
    if isinstance(ln, Line):
        return ln
    ln = g.edge_attribute(e, "line")
    if isinstance(ln, Line):
        return ln
    if ln:
        return Line(Point(*ln[0]), Point(*ln[1]))
    u, v = e
    pu = g.node_attribute(u, "point")
    pv = g.node_attribute(v, "point")
    return Line(pu, pv) if pu and pv else None

def sync_node_points_from_edges(g, edges):
    """
    Sync node 'point' from current edge geometry (line/shifted_lines).
    Uses best endpoint-node matching per edge, then averages per node.
    """
    acc = {}  # node -> [Point,...]

    for e in edges:
        u, v = e
        ln = _edge_line(g, e)
        if ln is None:
            continue

        pu = g.node_attribute(u, "point")
        pv = g.node_attribute(v, "point")
        if pu is None or pv is None:
            continue

        # choose endpoint mapping that best matches current node positions
        s, t = ln.start, ln.end
        score_uv = _dist(s, pu) + _dist(t, pv)
        score_vu = _dist(t, pu) + _dist(s, pv)

        if score_uv <= score_vu:
            mu, mv = s, t
        else:
            mu, mv = t, s

        acc.setdefault(u, []).append(mu)
        acc.setdefault(v, []).append(mv)

    for n, pts in acc.items():
        if not pts:
            continue
        x = sum(p.x for p in pts) / len(pts)
        y = sum(p.y for p in pts) / len(pts)
        z = sum(p.z for p in pts) / len(pts)
        g.node_attribute(n, "point", Point(x, y, z))

def edges_by_hierarchy(g, h):
    return [e for e in g.edges() if g.edge_attribute(e, "hierarchy") == h]

# -----------------------------
# 1) classify
# -----------------------------
primary_lines, secondary_lines, tertiary_lines, data = edge_classifier.classify_edges_by_support_direction(
    graph,
    debug=False,
    return_tertiary=True
)

for d0 in data:
    e0 = d0["edge"]
    t0 = d0.get("type")
    if t0 in ("primary", "secondary", "tertiary", "double"):
        graph.edge_attribute(e0, "hierarchy", "primary" if t0 == "double" else t0)

# -----------------------------
# 2) reciprocal primary
# -----------------------------
primary_edges = [d0["edge"] for d0 in data if d0.get("type") in ("primary", "double")]

res_primary = reciprocal.reciprocal_width_from_subgraph(
    graph,
    target_edges=primary_edges,
    engage_len=engage_len,
    tol=tol,
    rotation_sign=sign_primary,
    min_degree=3,
    iterations=iters,
    debug=False,
    straight_angle_threshold_deg=180.0
)
g = res_primary["graph"]

# -----------------------------
# 3) regenerate secondary + tertiary (level 1 up)
# -----------------------------
line_constraints.regenerate_edges(
    g,
    target_hierarchy="secondary",
    move_node_level=1,
    host_hierarchy="primary",
    choose="up",
    write_attribute=True,
    debug=False
)
line_constraints.commit_generated_lines(g, hierarchy_filter="secondary", clear_generated=True)

line_constraints.regenerate_edges(
    g,
    target_hierarchy="tertiary",
    move_node_level=1,
    host_hierarchy="primary",
    choose="up",
    write_attribute=True,
    debug=False
)
line_constraints.commit_generated_lines(g, hierarchy_filter="tertiary", clear_generated=True)

# IMPORTANT: sync node points from updated secondary geometry before secondary reciprocal
secondary_edges = edges_by_hierarchy(g, "secondary")
sync_node_points_from_edges(g, secondary_edges)

# -----------------------------
# 4) reciprocal secondary
# -----------------------------
res_secondary = reciprocal.reciprocal_width_from_subgraph(
    g,
    target_edges=secondary_edges,
    engage_len=engage_len,
    tol=tol,
    rotation_sign=sign_secondary,
    min_degree=3,
    iterations=iters,
    debug=False,
    straight_angle_threshold_deg=180.0
)
g = res_secondary["graph"]

# optional: keep nodes consistent after secondary reciprocal too
sync_node_points_from_edges(g, secondary_edges)

# -----------------------------
# 5) regenerate tertiary (level 0 up)
# -----------------------------
line_constraints.regenerate_edges(
    g,
    target_hierarchy="tertiary",
    move_node_level=0,
    host_hierarchy="secondary",
    choose="up",
    write_attribute=True,
    debug=False
)
line_constraints.commit_generated_lines(g, hierarchy_filter="tertiary", clear_generated=True)

line_constraints.regenerate_edges(
    g,
    target_hierarchy="tertiary",
    move_node_level=0,
    host_hierarchy="primary",
    choose="up",
    write_attribute=True,
    debug=False
)
line_constraints.commit_generated_lines(g, hierarchy_filter="tertiary", clear_generated=True)

# outputs
graph_out = g
edges = g.edge_lines() #original edges
a = res_primary["shifted_lines"]
b = res_secondary["shifted_lines"]

shifted = []
for e in g.edges():
    ln = g.edge_attribute(e, "shifted_lines")
    shifted.append(ln)
# ---------- end py3_3 ----------
draw_16 = COMPASDraw(cg=py3_3.shifted)  # -> rg; disabled; same code as compas_draw
draw_17 = COMPASDraw(cg=py3_3.a)  # -> rg; disabled; same code as compas_draw
draw_18 = COMPASDraw(cg=py3_3.b)  # -> rg; disabled; same code as compas_draw
draw_19 = COMPASDraw(cg=py3_3.c)  # -> rg; disabled; same code as compas_draw
draw_20 = COMPASDraw(cg=py3_3.d)  # -> rg; disabled; same code as compas_draw
draw_21 = COMPASDraw(cg=py3_3.f)  # -> rg; disabled; same code as compas_draw

line = Line(draw_16)  # disabled
beam = CTBeam(centerline=line, width=number_slider_3, height=number_slider_2)  # -> Beam, Blank; inputs centerline: list, z_vector: list of Vector3d, width: list of Double, height: list of Double, category: list of String, updateRefObj: Boolean; disabled
#   port centerline: Referenced curve or line, Guid of curve or line in the active Rhino document.
#   port z_vector: Vector defining the orientation of the cross-section (corresponds to the height dimension). If None, a default will be taken.
#   port width: Width of the cross-section (usually the smaller dimension).
#   port height: Height of the cross-section (usually the larger dimension).
#   port category: Category of a beam.
#   port updateRefObj: (optional) If True, the attributes in the referenced object will be updated/overwritten with the new values given here.
#   port Beam: Beam object(s).
#   port Blank: Shape of the beam's blank.
# ---------- beam: Python ----------
# env: C:\Users\jfrancisco\Documents\GitHub\timber_design\src
# r: compas_timber>=0.16.2
"""Creates a Beam from a LineCurve."""

# flake8: noqa
import Grasshopper
import Rhino
import rhinoscriptsyntax as rs
import System
from compas.scene import Scene
from compas_rhino.conversions import line_to_compas
from compas_rhino.conversions import vector_to_compas

from compas_timber.elements import Beam as CTBeam
from timber_design.ghpython.ghcomponent_helpers import list_input_valid_cpython


class Beam_fromCurve(Grasshopper.Kernel.GH_ScriptInstance):
    def RunScript(self,
            centerline: System.Collections.Generic.List[object],
            z_vector: System.Collections.Generic.List[Rhino.Geometry.Vector3d],
            width: System.Collections.Generic.List[float],
            height: System.Collections.Generic.List[float],
            category: System.Collections.Generic.List[str],
            updateRefObj: bool):
        # minimum inputs required
        if not list_input_valid_cpython(ghenv, centerline, "Centerline"):
            return
        if not width:
            length = self._get_centerline_length(centerline)
            width = [length / 20]
        if not height:
            length = self._get_centerline_length(centerline)
            height = [length / 10]

        # reformat unset parameters for consistency
        if not z_vector:
            z_vector = [None]
        if not category:
            category = [None]

        beams = []
        blanks = []
        scene = Scene()

        if centerline and height and width:
            # check list lengths for consistency
            N = len(centerline)
            if len(z_vector) not in (0, 1, N):
                ghenv.Component.AddRuntimeMessage(
                    Grasshopper.Kernel.GH_RuntimeMessageLevel.Error, " In 'ZVector' I need either none, one or the same number of inputs as the Crv parameter."
                )
            if len(width) not in (1, N):
                ghenv.Component.AddRuntimeMessage(Grasshopper.Kernel.GH_RuntimeMessageLevel.Error, " In 'W' I need either one or the same number of inputs as the Crv parameter.")
            if len(height) not in (1, N):
                ghenv.Component.AddRuntimeMessage(Grasshopper.Kernel.GH_RuntimeMessageLevel.Error, " In 'H' I need either one or the same number of inputs as the Crv parameter.")
            if len(category) not in (0, 1, N):
                ghenv.Component.AddRuntimeMessage(
                    Grasshopper.Kernel.GH_RuntimeMessageLevel.Error, " In 'Category' I need either none, one or the same number of inputs as the Crv parameter."
                )

            # duplicate data if None or single value
            if len(z_vector) != N:
                z_vector = [z_vector[0] for _ in range(N)]
            if len(width) != N:
                width = [width[0] for _ in range(N)]
            if len(height) != N:
                height = [height[0] for _ in range(N)]
            if len(category) != N:
                category = [category[0] for _ in range(N)]

            for line, z, w, h, c in zip(centerline, z_vector, width, height, category):
                guid, geometry = self._get_guid_and_geometry(line)
                rhino_line = rs.coerceline(geometry)
                line = line_to_compas(rhino_line)

                z = vector_to_compas(z) if z else None
                beam = CTBeam.from_centerline(centerline=line, width=w, height=h, z_vector=z)
                beam.attributes["rhino_guid"] = str(guid) if guid else None
                beam.attributes["category"] = c


                beams.append(beam)
                scene.add(beam.blank)

        blanks = scene.draw()

        return beams, blanks

    def _get_guid_and_geometry(self, line):
        # internalized curves and GH geometry will not have persistent GUIDs, referenced Rhino objects will
        # type hint on the input has to be 'ghdoc' for this to work
        guid = None
        geometry = line
        rhino_obj = Rhino.RhinoDoc.ActiveDoc.Objects.FindId(line)
        if rhino_obj:
            guid = line
            geometry = rhino_obj.Geometry
        return guid, geometry

    def _get_centerline_length(self, centerline):
        centerline_length = []
        for i in centerline:
            centerline_length.append(rs.CurveLength(i))
        if centerline_length:
            length_average = sum(centerline_length) / len(centerline_length)
        else:
            length_average = 1
        return length_average
# ---------- end beam ----------

# ----
# lines for compas_timber from graph
py3_4 = Python3Script(graph=py3_2.graph_out)  # -> out, a, b, c
# ---------- py3_4: Python ----------
from compas.geometry import Line, Point
from copy import deepcopy

ng = deepcopy(graph)

primary_shifted = []
secondary_shifted = []
tertiary_shifted = []

for e in ng.edges():
    h = ng.edge_attribute(e, "hierarchy")      # classification
    ln = ng.edge_attribute(e, "shifted_lines")  # shifted geometry
    if ln is None:
        continue

    if h == "primary":
        primary_shifted.append(ln)
    elif h == "secondary":
        secondary_shifted.append(ln)
    elif h == "tertiary":
        tertiary_shifted.append(ln)

a = primary_shifted
b = secondary_shifted
c = tertiary_shifted
# ---------- end py3_4 ----------
draw_22 = COMPASDraw(cg=py3_4.b)  # -> rg; same code as compas_draw
draw_23 = COMPASDraw(cg=py3_4.a)  # -> rg; same code as compas_draw
draw_24 = COMPASDraw(cg=py3_4.c)  # -> rg; same code as compas_draw
