# Grasshopper definition line_model_v3.ghx (Grasshopper 1.0.8)
# plug-ins: Human

# ----
# * Params
height = Panel("5.12")
height_2 = Panel("9.12")
merge = Merge(
    Data1="0",
    Data2=Slider(0.705, range=0.001..1),
    Data3=Slider(1.574, range=1.001..3),
    Data4=Slider(3.404, range=3.001..5),
    Data5=height_2)
merge_2 = Merge(
    Data1="0",
    Data2=Slider(0.917, range=0.001..1),
    Data3=Slider(1.013, range=0.701..1.5),
    Data4=Slider(2.277, range=1.501..3),
    Data5=height)
bnd = Bounds(Numbers=merge)
bnd_2 = Bounds(Numbers=merge_2)
remap = RemapNumbers(Value=merge, Source=bnd, Target=Domain(0, 1))  # -> Mapped, Clipped
remap_2 = RemapNumbers(Value=merge_2, Source=bnd_2, Target=Domain(0, 1))  # -> Mapped, Clipped
entwine = Entwine(Branch00=remap.Mapped, Branch01=remap_2.Mapped, FlattenInputs=True)  # -> simplify(Result)

py3 = Python3Script(l=Slider(5, range=0..10), coeff_h=Slider(0.43, range=0..1))  # -> out, D_heigts; inputs l: Int32, coeff_h: Double
# ---------- py3: Python ----------
import Rhino.Geometry as rg
import math
from ghpythonlib.treehelpers import list_to_tree, tree_to_list


def expo_num(coeff):
    max_heigth = 1
    h_coeficient = []
    for n in range(l):
        y = coeff ** (n*(-1)) # number 2 can be change so the exponential changes
        h_coeficient.append(abs(y - 1))
    heigts = []
    print(h_coeficient)
    for n in h_coeficient:
        param = n/h_coeficient[-1]
        r = max_heigth * param
        h = r - max_heigth
        # heigts.append(round(r, 1))
        heigts.append(r)
    D = heigts
    return D

D_heigts = expo_num(coeff_h)
# ---------- end py3 ----------
panel = Panel(py3.D_heigts)

curve = Curve(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)
brep = Brep(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)
point = Point([Point(163.54, 57.72, 15.455), Point(163.54, 48.1, 15.455), Point(173.16, 48.1, 19.455), Point(173.16, 57.72, 19.455)])

# ----
# * 120mm of CLT thickness &
# 80mm of half of the shoe thickness
panel_2 = Panel("{0, 0, -0.2}")
move = Move(Geometry=brep, Motion=panel_2)  # -> Geometry, Transform

# ----
# create and manipulate graph
python_3_script = Python3Script(boundary=curve, roof_brep=move.Geometry, supports=point, z_steps=entwine)  # -> out, ridges_tree, all_edges, graph, all_nodes, node_keys; inputs boundary: Curve, roof_brep: Brep, supports: list of Point3d, z_steps: tree of Double
# ---------- python_3_script: Python ----------
import os
import sys
from compas_rhino import unload_modules
import compas
compas.PRECISION = ".3f"

gh_dir = os.path.dirname(ghenv.Component.OnPingDocument().FilePath)
sys.path.append(gh_dir)

import tree_builder
import nodegraph
import importlib

importlib.reload(nodegraph)
importlib.reload(tree_builder)


from tree_builder import build_tree_graph
from Grasshopper import DataTree
from Grasshopper.Kernel.Data import GH_Path

# lines_tree will be our output
lines_tree = DataTree[object]()
z_tree = []
# 1. Iterate using the Branch count
for i in range(z_steps.BranchCount):
    branch = list(z_steps.Branch(i)) 
    z_tree.append(branch)

print(type(z_tree[1]))

# CONSTANTS #
div_x = 8
div_y = 6
num_levels = 4

inset_edge = 0.5
inset_interior = 0.5

# Build the graph (all logic is in tree_builder.py)
ng = build_tree_graph(
    boundary=boundary,
    supports=supports,
    roof_brep=roof_brep,
    div_x=div_x if div_x else 8,
    div_y=div_y if div_y else 6,
    num_levels=num_levels if num_levels else 4,
    z_steps=z_tree,
    inset_edge=inset_edge if inset_edge else 0.5,
    inset_interior=inset_interior if inset_interior else 0.4,
    reach_tol=0.05,
    debug=False
)

# Outputs
all_edges = ng.edge_lines()
graph = ng
all_nodes = ng.node_points()
node_keys = list(ng.nodes())

print(*graph.edges_attribute('main_secondary'))
print(*graph.edges_attributes())
# ---------- end python_3_script ----------
compas_draw = COMPASDraw(cg=python_3_script.all_edges)  # -> rg
#   port cg: The COMPAS geometry or datastructure to be drawn.
#   port rg: The Rhino geometry object.
# ---------- compas_draw: Python ----------
# r: compas>=2.14.1
"""
Draws COMPAS geometry in Grasshopper.
"""

from typing import Any

import Grasshopper

from compas.scene import SceneObject


class CompasToRhinoGeometry(Grasshopper.Kernel.GH_ScriptInstance):
    def RunScript(self, cg):
        if not cg:
            return None

        return SceneObject(item=cg).draw()
# ---------- end compas_draw ----------
compas_draw_2 = COMPASDraw(cg=python_3_script.all_nodes)  # -> rg; same code as compas_draw
python_3_script_2 = Python3Script(graph=python_3_script.graph)  # -> out, edges, nodes, idx, node_graph, a, b, c
# ---------- python_3_script_2: Python ----------
from copy import deepcopy
import os
import sys

gh_dir = os.path.dirname(ghenv.Component.OnPingDocument().FilePath)
if gh_dir not in sys.path:
    sys.path.insert(0, gh_dir)

ng = deepcopy(graph)

# Delete nodes
for node_id in [288, 289]:
    if ng.has_node(node_id):
        ng.delete_node(node_id)

# Add new elements
target_pairs = [
    [286, 274, 275, True], [287, 276, 277, True], [290, 278, 279, True], [291, 280, 281, True],
    [286, 270, 271, False], [287, 272, 273, False], [290, 282, 283, False], [291, 284, 285, False],
    [246, 44, 81, False], [246, 48, 87, False], [248, 54, 91, False], [248, 58, 97, False],
    [258, 124, 161, False], [258, 128, 167, False], [260, 134, 171, False], [260, 138, 177, False],
    [249, 64, 101, False], [249, 68, 107, False], [251, 74, 111, False], [251, 78, 117, False],
    [261, 144, 181, False], [261, 148, 187, False], [263, 154, 191, False], [263, 158, 197, False],
    [286, 246], [287, 249], [290, 258], [291, 261],
    [286, 248], [287, 251], [290, 260], [291, 263],
    [296, 241], [297, 244], [298, 265], [299, 268],
    [296, 247], [297, 250], [298, 259], [299, 262],
    [296, 270], [297, 272], [298, 282], [299, 284],
    [296, 271], [297, 273], [298, 283], [299, 285],
]

ng.add_segments(target_pairs)


edges = ng.edge_lines_by_group(0) + ng.edge_lines_by_group(1)
nodes = ng.node_points()
idx = list(ng.nodes())
node_graph = ng

a = ng.points_by_mobility("fixed")     # supports + inset corners
b = ng.points_by_mobility("z_free")    # apex nodes
c = ng.points_by_mobility("yz_free")  # added via add_segment

double = []
primary = []

### -----------------------------
## PRINT
### -----------------------------
# print(is_clear)
# print(anchor_joint)
# print(*ng.node_attributes(286))
# print(ng.edge_attribute((270, 246), 'hierarchy'))
for edge, line in zip(node_graph.edges(), node_graph.edge_lines()):
    if node_graph.edge_attribute(edge, 'main_secondary') == "double":
        print(line)
        double.append(line)
    if node_graph.edge_attribute(edge, 'main_secondary') == "primary":
        print(line)
        primary.append(line)
for i, edge in enumerate(node_graph.edges()):
    lens = len(node_graph.edges_attributes()[i].keys())
    # print(lens)
    if lens > 2:
        print(*node_graph.edges_attributes()[i].keys())
# ---------- end python_3_script_2 ----------

custom_preview_lineweights = CustomPreviewLineweights(
    Geometry=compas_draw,
    Shader=ColourSwatch(SwatchColor=RGB(144, 209, 232)),
    Thickness=Slider(4, range=0..10),
    Absolute=False)

swatch = ColourSwatch(SwatchColor=RGB(51, 56, 66))
text_tag = TextTag(Location=compas_draw_2, Text=python_3_script.node_keys, Colour=swatch)
dot_display = DotDisplay(Point=compas_draw_2, Colour=swatch, Size=Slider(0.1, range=0..0.1))

# ----
# Transform points
number_slider = Slider(1, range=0..10)
brep_2 = Brep(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)
python_3_script_3 = Python3Script(graph=python_3_script_2.node_graph, interior_brep=brep_2, move=Toggle(True), sub_iterations=number_slider)  # -> out, edges, nodes, node_keys, idx, node_graph, a, b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; inputs interior_brep: Brep, sub_iterations: Int32
# ---------- python_3_script_3: Python ----------
import os, sys, importlib
gh_dir = os.path.dirname(ghenv.Component.OnPingDocument().FilePath)
if gh_dir not in sys.path:
    sys.path.insert(0, gh_dir)

### -----------------------------
## IMPORT
### -----------------------------
import edge_classifier
import transformer
import nodegraph

importlib.reload(edge_classifier)
importlib.reload(transformer)
importlib.reload(nodegraph)

from edge_classifier import classify_single_segment
from transformer import edge_in_brep
from nodegraph import NodeGraph
from copy import deepcopy
from compas.geometry import Vector, Line, Point, centroid_points

### -----------------------------
## INITIALIZATION
### -----------------------------
ng = deepcopy(graph)

### -----------------------------
## EXECUTION
### -----------------------------
if move:
    intersecting_edges, is_clear, moved_points, pt = edge_in_brep(ng, interior_brep, sub_iterations=sub_iterations, debug=True)

target_pairs = [[298, 290], [296, 286], [297, 287], [299, 291]]
movement_data = [[graph.node_attribute(pair[0], "point"), ng.edge_line(pair).vector, pair[0]] for pair in target_pairs]
move = [ng.node_attribute(data[2], "point", data[0] + data[1]/3) for data in movement_data]

move = []
for data in movement_data:
    key = data[2]
    moved_pt = data[0] + data[1]/3
    move.append(ng.node_attribute(key, "point", moved_pt))
    ng.node_attributes(key, names=["x", "y", "z"], values=[moved_pt.x, moved_pt.y, moved_pt.z])

ng.mark_y_parallel_as_double() # extract double lines

offset, attr, intersection_pts = ng.offset_double_edges() # offset double edges


### -----------------------------
## OUTPUTS
### -----------------------------
edges = ng.edge_lines_by_group(0) + ng.edge_lines_by_group(1)
nodes = ng.node_points()
idx = list(ng.nodes())
node_graph = ng

a = ng.points_by_mobility("fixed")     # supports + inset corners
b = ng.points_by_mobility("z_free")    # apex nodes
c = ng.points_by_mobility("yz_free")  # added via add_segment

double = []
primary = []
main_secondary = []

node_keys = list(node_graph.nodes())
# int_pts = [pt for keys, pts in list(intersection_pts.items()) for pt in pts]
int_pts = [pt for keys, pts in list(intersection_pts.items()) for pt in pts]

### -----------------------------
## PRINT
### -----------------------------
# print(is_clear)
# print(anchor_joint)
# print(*ng.node_attributes(322))
# print(ng.edge_attribute((270, 246), 'hierarchy'))
for edge, line in zip(node_graph.edges(), node_graph.edge_lines()):
    if node_graph.edge_attribute(edge, 'main_secondary') == "double":
        double.append(line)
    if node_graph.edge_attribute(edge, 'main_secondary') == "primary":
        primary.append(line)
    if node_graph.edge_attribute(edge, 'main_secondary'):
        main_secondary.append(line)
for i, edge in enumerate(node_graph.edges()):
    lens = len(node_graph.edges_attributes()[i].keys())
    # print(lens)
    # if lens > 2:
        # print(*node_graph.edges_attributes()[i].keys())

# print(*node_graph.edges_attribute('main_secondary'))
# print(*node_graph.nodes_attributes())
# print(attr)
print(int_pts)
# ---------- end python_3_script_3 ----------

compas_draw_3 = COMPASDraw(cg=python_3_script_2.edges)  # -> rg; same code as compas_draw

compas_draw_4 = COMPASDraw(cg=python_3_script_3.moved_points)  # -> rg; same code as compas_draw
dot_display_2 = DotDisplay(Point=compas_draw_4, Colour=ColourSwatch(SwatchColor=RGB(255, 255, 255)), Size=Slider(0.2, range=-0.5..0.5))

compas_draw_5 = COMPASDraw(cg=python_3_script_3.nodes)  # -> rg; same code as compas_draw

swatch_2 = ColourSwatch(SwatchColor=RGB(51, 56, 66))
text_tag_2 = TextTag(Location=compas_draw_5, Text=python_3_script_3.node_keys, Colour=swatch_2)
dot_display_3 = DotDisplay(Point=compas_draw_5, Colour=swatch_2, Size=Slider(0.1, range=0..0.1))

compas_draw_6 = COMPASDraw(cg=python_3_script_3.edges)  # -> rg; same code as compas_draw
compas_draw_7 = COMPASDraw(cg=python_3_script_3.double)  # -> rg; same code as compas_draw

custom_preview_lineweights_2 = CustomPreviewLineweights(
    Geometry=compas_draw_7,
    Shader=ColourSwatch(SwatchColor=RGB(144, 209, 232)),
    Thickness=Slider(4, range=0..10),
    Absolute=False)

compas_draw_8 = COMPASDraw(cg=python_3_script_3.offset)  # -> rg; same code as compas_draw
compas_draw_9 = COMPASDraw(cg=python_3_script_3.int_pts)  # -> rg; same code as compas_draw
panel_3 = Panel("""0
1
2
3
8
9
10
11""")

# ----
# Classfiy Edges
toggle = BooleanToggle(True)
panel_4 = Panel("""4
5
12
13""")
python_3_script_4 = Python3Script(graph=python_3_script_3.node_graph, sub=toggle, sub_ids=panel_3)  # -> out, primary, secondary, tertiary, special, graph_out; inputs sub: Boolean, sub_ids: list of Int32
# ---------- python_3_script_4: Python ----------
import os, sys, importlib
gh_dir = os.path.dirname(ghenv.Component.OnPingDocument().FilePath)
if gh_dir not in sys.path:
    sys.path.insert(0, gh_dir)

import edge_classifier_v3
importlib.reload(edge_classifier_v3)
from edge_classifier_v3 import combine_graphs, classify_edges_by_Michael

from Grasshopper import DataTree
from Grasshopper.Kernel.Data import GH_Path


subgraphs = classify_edges_by_Michael(graph, seg_x=8, seg_y=2)

primary = DataTree[object]()
secondary = DataTree[object]()
tertiary = DataTree[object]()
special = DataTree[object]()

for i, sg in enumerate(subgraphs):
    path = GH_Path(i)

    for node in sg.nodes():
        attrs_n = sg.node_attributes(node)
        # print (attrs_n)
    
    for edge in sg.edges():
        attrs_e = sg.edge_attributes(edge)
        # print (attrs_e)
        
        hie = "hierarchy"
        if hie not in attrs_e:
            continue
        
        if sub and i not in sub_ids:
            continue

        if attrs_e[hie] == "primary":
            primary.Add(sg.edge_line(edge), path)
        elif attrs_e[hie] == "secondary":
            secondary.Add(sg.edge_line(edge), path)
        elif attrs_e[hie] == "tertiary":
            tertiary.Add(sg.edge_line(edge), path)
        elif attrs_e[hie] == "special":
            special.Add(sg.edge_line(edge), path)
    

sgs = []
if not sub:
    sub_ids = list(range(len(subgraphs)))
    
for i in sub_ids:
    sgs.append(subgraphs[i])
graph_out = combine_graphs(sgs)
# ---------- end python_3_script_4 ----------
draw = COMPASDraw(cg=python_3_script_4.primary)  # -> rg; same code as compas_draw
draw_2 = COMPASDraw(cg=python_3_script_4.secondary)  # -> rg; same code as compas_draw
draw_3 = COMPASDraw(cg=python_3_script_4.tertiary)  # -> rg; same code as compas_draw
draw_4 = COMPASDraw(cg=python_3_script_4.special)  # -> rg; same code as compas_draw
custom_preview_lineweights_3 = CustomPreviewLineweights(Geometry=draw_3, Shader=ColourSwatch(SwatchColor=RGB(189, 172, 66)), Thickness="3", Absolute=False)
custom_preview_lineweights_4 = CustomPreviewLineweights(Geometry=draw, Shader=ColourSwatch(SwatchColor=RGB(137, 50, 143)), Thickness="8", Absolute=False)
custom_preview_lineweights_5 = CustomPreviewLineweights(Geometry=draw_2, Shader=ColourSwatch(SwatchColor=RGB(50, 143, 103)), Thickness="6", Absolute=False)
custom_preview_lineweights_6 = CustomPreviewLineweights(Geometry=draw_4, Shader=ColourSwatch(SwatchColor=RGB(78, 207, 222)), Thickness="3", Absolute=False)

# ----
# Snap leaf points and create shoes
brep_3 = Brep(move.Geometry)
python_3_script_5 = Python3Script(graph=python_3_script_4.graph_out, brep=brep_3)  # -> out, graph_out, leaf_lines, leaf_points, shoe_lines, other_lines; inputs brep: Brep
# ---------- python_3_script_5: Python ----------
import os, sys, importlib
gh_dir = os.path.dirname(ghenv.Component.OnPingDocument().FilePath)
if gh_dir not in sys.path:
    sys.path.insert(0, gh_dir)


import leaf_solver
importlib.reload(leaf_solver)
from leaf_solver import create_shoes_and_shift_leaves
from copy import deepcopy



ng = deepcopy(graph)

result = create_shoes_and_shift_leaves(ng, brep, min_length=0.30, min_angle=20)


########--------Output Data---------#########
leaf_lines = [ng.edge_line(edge) for edge in ng.edges() if ng.is_leaf_edge(edge)]
other_lines = [ng.edge_line(edge) for edge in ng.edges() if not ng.is_leaf_edge(edge)]

leaf_points = result["leaf_points"]
shoe_lines = result["shoe_lines"]

graph_out = ng

#############-----------Print----------##########
group = result["group_dict"]
print (group)
# ---------- end python_3_script_5 ----------
draw_5 = COMPASDraw(cg=python_3_script_5.shoe_lines)  # -> rg; same code as compas_draw
draw_6 = COMPASDraw(cg=python_3_script_5.other_lines)  # -> rg; same code as compas_draw
draw_7 = COMPASDraw(cg=python_3_script_5.leaf_points)  # -> rg; same code as compas_draw
draw_8 = COMPASDraw(cg=python_3_script_5.leaf_lines)  # -> rg; same code as compas_draw

# ----
# Run reciprocal
python_3_script_6 = Python3Script(graph=python_3_script_5.graph_out)  # -> out, primary, secondary, double, new_ng
# ---------- python_3_script_6: Python ----------
import os, sys, importlib
gh_dir = os.path.dirname(ghenv.Component.OnPingDocument().FilePath)
if gh_dir not in sys.path:
    sys.path.insert(0, gh_dir)

import edge_classifier
import config
import reciprocal

importlib.reload(config)
importlib.reload(edge_classifier)
importlib.reload(reciprocal)

from edge_classifier import create_subgraphs,classify_subgraph_edges,classify_edges_by_support_direction
from reciprocal import reciprocal_from_subgraph, reciprocal_width_from_subgraph

from compas.geometry import Line
from copy import deepcopy

ng = deepcopy(graph)
# classify_edges_by_support_direction(graph, parallel_tol=0.9)
# subgraphs = create_subgraphs(graph, seg_x=8, seg_y=2) # could change double divisions here
# sup_pts = graph.get_support_points()

# # Then fetch any segment on demand
# def get_segment(idx):
#     sg_data = subgraphs[idx % len(subgraphs)]
#     return classify_subgraph_edges(sg_data, sup_pts, near_threshold=1.0, parallel_tol=0.9)

# # Use it
# primary, secondary, double, near_sup, subgraph = get_segment(segment_id)
# print(graph[1])
result = reciprocal_width_from_subgraph(graph, engage_len=.11, debug = True)
print(result)
primary = result["shifted_lines"]
secondary = result["secondary_lines"]

new_ng = ng
# ---------- end python_3_script_6 ----------
compas_draw_10 = COMPASDraw(cg=python_3_script_6.primary)  # -> rg; same code as compas_draw
compas_draw_11 = COMPASDraw(cg=python_3_script_6.secondary)  # -> rg; same code as compas_draw
compas_draw_12 = COMPASDraw(cg=python_3_script_6.double)  # -> rg; same code as compas_draw
py3_2 = Python3Script(x=python_3_script_6.primary)  # -> out, geom; inputs x: list; disabled
# ---------- py3_2: Python ----------
import compas
from compas.scene import Scene
from compas_timber.model import TimberModel
from compas_timber.elements import Beam
from compas_timber.connections import TStepJoint
# from compas_timber.connections import TopologyRules
from compas_timber.connections.solver import ConnectionSolver
from compas_timber.connections import ConnectionSolver
from compas.tolerance import TOL, Tolerance


model = TimberModel(Tolerance(unit='MM'))

for l in x:
    b = Beam.from_centerline(l, 0.14, 0.24)
    model.add_element(b)

rules = []
# rules.append(TopologyRules(JointTopology.TOPO_T, TStepJoint))

solver = ConnectionSolver()
pairs = solver.find_intersecting_pairs(model.beams)
for pair in pairs:
    topo = solver.find_topology(*pair)
    if topo.topology == 3:
        TStepJoint.create(model, topo.beam_a, topo.beam_b)

model.process_joinery()

scene = Scene()
for b in model.beams:
    scene.add(b.geometry)
geom = scene.draw()
# ---------- end py3_2 ----------

python_3_script_7 = Python3Script(graph=python_3_script_6.new_ng)  # -> out, graph_out, crosecs, cut_planes, sup_lines
# ---------- python_3_script_7: Python ----------
import os, sys, importlib
gh_dir = os.path.dirname(ghenv.Component.OnPingDocument().FilePath)
if gh_dir not in sys.path:
    sys.path.insert(0, gh_dir)


import foundation_solver
importlib.reload(foundation_solver)
from foundation_solver import trim_anchored_beams_and_find_cut_planes
from copy import deepcopy

from compas.geometry import Polygon

############--------Main Code----------#########
ng = deepcopy(graph)
result = trim_anchored_beams_and_find_cut_planes(ng, min_gap=0.01, min_height=0.0)

########--------Output Data---------#########
cro_sec_dict = result["cross_sections"]
crosecs = []
for node, cro_sec_list in cro_sec_dict.items():
    for crosec in cro_sec_list:
        poly = Polygon(crosec)
        crosecs.append(poly)

cut_pln_dict = result["cut_planes"]
cut_planes = []
for node, pln in cut_pln_dict.items():
    cut_planes.append(pln)


sup_lines = []
for edge in graph.get_support_edges():
    if "shifted_line" in graph.edge_attributes(edge):
        ln = graph.edge_attribute(edge, "shifted_line")
    else:
        ln = graph.edge_line(edge)
    sup_lines.append(ln)

#############-----------Print----------##########
# print (result["cross_sections"])
# print ()
# print (result["cut_planes"])
print (result["foundation_heights"])
# ---------- end python_3_script_7 ----------
draw_9 = COMPASDraw(cg=python_3_script_7.crosecs)  # -> rg; same code as compas_draw
draw_10 = COMPASDraw(cg=python_3_script_7.cut_planes)  # -> rg; same code as compas_draw
draw_11 = COMPASDraw(cg=python_3_script_7.sup_lines)  # -> rg; same code as compas_draw
preview = CustomPreview(
    Geometry=py3_2.geom,
    Material={diffuse=RGB(221, 160, 221), emission=RGB(66, 48, 66), shine=0.5, specular=RGB(255, 255, 255), transparency=0})
brep_4 = Brep([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])
python_3_script_8 = Python3Script(graph=python_3_script_6.new_ng, floor=brep_4, node=Slider(11, range=0..20))  # -> out, edges, nodes, idx, result, pts; inputs floor: list of Brep, node: Int32
# ---------- python_3_script_8: Python ----------
import os, sys, importlib
gh_dir = os.path.dirname(ghenv.Component.OnPingDocument().FilePath)
if gh_dir not in sys.path:
    sys.path.insert(0, gh_dir)

### -----------------------------
## IMPORT
### -----------------------------
import edge_classifier
import transformer
import nodegraph
import shifting_solver

importlib.reload(edge_classifier)
importlib.reload(transformer)
importlib.reload(nodegraph)
importlib.reload(shifting_solver)

from edge_classifier import classify_single_segment
from transformer import edge_in_brep
from copy import deepcopy
from compas.geometry import Vector, Line, Point, centroid_points
from shifting_solver import shift_from_subgraph


from Grasshopper import DataTree
from Grasshopper.Kernel.Data import GH_Path

### -----------------------------
## INITIALIZATION
### -----------------------------
ng = deepcopy(graph)

### -----------------------------
## EXECUTION
### -----------------------------
result, pts = shift_from_subgraph(ng, node, debug=False)        

### -----------------------------
## OUTPUTS
### -----------------------------

lines_tree = DataTree[object]()
pts_tree = DataTree[object]()

print(pts_tree)
for i, lst in enumerate(result):
    path = GH_Path(i)
    # lines_tree.AddRange(lst, path)
    for ln in lst:
        lines_tree.Add(ln, path)

for i, lst in enumerate(pts):
    path = GH_Path(i)
    # lines_tree.AddRange(lst, path)
    for ln in lst:
        lines_tree.Add(ln, path)

### -----------------------------
## PRINT
### -----------------------------
# print(anchor_joint)
# print(*ng.node_attributes(286))
# print(ng.edge_attribute((270, 246), 'hierarchy'))
print(result)
# ---------- end python_3_script_8 ----------
compas_draw_13 = COMPASDraw(cg=python_3_script_8.result)  # -> rg; same code as compas_draw
tstat = TreeStatistics(Tree=compas_draw_13)  # -> Paths, Length, Count
item = ListItem(List=tstat.Paths, Index=0, Wrap=True)
branch = TreeBranch(Tree=compas_draw_13, Path=item, MaintainPaths=True)
