# Grasshopper definition base_plates.ghx (Grasshopper 1.0.8)
# plug-ins: Human, LadybugGrasshopper

falsestart = LBFalseStartToggle(False)
falsestart_2 = LBFalseStartToggle(True)
number_slider = Slider(0.14, range=0..1)
number_slider_2 = Slider(0.3, range=0..1)
list = ValueList({"parallel_to_ground", "Perpendicular_to_grain"}, selected="Perpendicular_to_grain")
falsestart_3 = LBFalseStartToggle(False)
py3 = Python3Script(target_cluster_index=Slider(1, range=1..4), include_stiffeners=falsestart, enabled=falsestart_2)  # -> out, preview_breps
# ---------- py3: Python ----------
import importlib.util
import os
import sys
import traceback

try:
    import Rhino  # type: ignore
except Exception:
    Rhino = None

ROOT = r"C:\Users\Juste\Documents\_GitHub\MAS-2526\10_llhil-t2-fabrication\design\structure_model\Base_Plates"
DEFAULT_PLATE_LENGTH = 0.8
DEFAULT_PLATE_WIDTH = 0.8
DEFAULT_PLATE_THICKNESS = 0.02
RUN_TAG = "BPG_WRAPPER_SYNC_2026_05_15_A"

# Diagnostic: print resolved path
print("[GH Wrapper] RUN_TAG:", RUN_TAG)
print("[GH Wrapper] ROOT:", ROOT)
HELPER_PATH = os.path.join(ROOT, "base_plate_geometry.py")
print("[GH Wrapper] HELPER_PATH:", HELPER_PATH)
print("[GH Wrapper] HELPER_EXISTS:", os.path.exists(HELPER_PATH))



def _load_helper():
    module_name = "base_plate_geometry"
    sys.modules.pop(module_name, None)
    spec = importlib.util.spec_from_file_location(module_name, HELPER_PATH)
    if spec is None or spec.loader is None:
        raise ImportError("Could not load {0}".format(HELPER_PATH))
    module = importlib.util.module_from_spec(spec)
    # Required for dataclasses/type resolution during module execution in GH Py3.
    sys.modules[module_name] = module
    try:
        spec.loader.exec_module(module)
    except Exception as e:
        print("[GH Wrapper] Error importing base_plate_geometry.py:", e)
        import traceback
        print(traceback.format_exc())
        raise
    return module


def _mm_to_doc_scale():
    if Rhino is None:
        return 1.0
    try:
        doc = Rhino.RhinoDoc.ActiveDoc
        if doc is None:
            return 1.0
        return float(Rhino.RhinoMath.UnitScale(Rhino.UnitSystem.Millimeters, doc.ModelUnitSystem))
    except Exception:
        return 1.0


def _scale_breps_copy(breps, scale_factor):
    if Rhino is None:
        return [b for b in (breps or []) if b is not None]
    if abs(scale_factor - 1.0) <= 1e-12:
        return [b for b in (breps or []) if b is not None]

    scaled = []
    transformed_count = 0
    passthrough_count = 0
    try:
        xform = Rhino.Geometry.Transform.Scale(Rhino.Geometry.Plane.WorldXY, scale_factor)
    except Exception:
        return [b for b in (breps or []) if b is not None]

    for geom in (breps or []):
        if geom is None:
            continue
        try:
            dup = None

            # Prefer geometry-preserving duplicate when available.
            duplicate = getattr(geom, "Duplicate", None)
            if callable(duplicate):
                dup = duplicate()

            # Fall back to Brep duplication path.
            if dup is None:
                duplicate_brep = getattr(geom, "DuplicateBrep", None)
                if callable(duplicate_brep):
                    dup = duplicate_brep()

            # Last resort: convert to Brep if possible.
            if dup is None:
                to_brep = getattr(geom, "ToBrep", None)
                if callable(to_brep):
                    try:
                        dup = to_brep(False)
                    except TypeError:
                        dup = to_brep()

            if dup is None:
                passthrough_count += 1
                scaled.append(geom)
                continue

            if not dup.Transform(xform):
                passthrough_count += 1
                scaled.append(geom)
                continue

            transformed_count += 1
            scaled.append(dup)
        except Exception:
            passthrough_count += 1
            scaled.append(geom)

    print(
        "[GH Wrapper] footing scale transform: transformed={0}, passthrough={1}".format(
            transformed_count,
            passthrough_count,
        )
    )
    return scaled


try:
    helper = _load_helper()

    if "enabled" in globals() and enabled is False:
        print("[GH Wrapper] Branch: disabled")
        out = "Base plate geometry disabled."
        payload = {}
        members = []
        base_plates = []
        preview_breps = []
    else:
        print("[GH Wrapper] Branch: active")
        kwargs = {}
        if "payload_override" in globals() and isinstance(payload_override, dict) and payload_override:
            payload = payload_override
        else:
            kwargs = {
                "plate_length": DEFAULT_PLATE_LENGTH,
                "plate_width": DEFAULT_PLATE_WIDTH,
                "plate_thickness": DEFAULT_PLATE_THICKNESS,
                "bottom_face_mode": "Perpendicular_to_grain",
                "target_support_nodes_only": True,
                "deduplicate_support_nodes": True,
                "geometry_kind": "footing",
            }
            if "line_model_path" in globals() and line_model_path:
                from pathlib import Path
                kwargs["line_model_path"] = Path(str(line_model_path))
            else:
                # Fallback for GH context: use absolute path to repo's line_model data
                from pathlib import Path
                data_dir = Path(r"C:\Users\Juste\Documents\_GitHub\MAS-2526\10_llhil-t2-fabrication\design\line_model\data")
                # Prefer exports with known ground supports before meter-shifted variants.
                for candidate in ["0806_shifted_lines.json", "shifted_lines.json", "meters_shifted_lines.json"]:
                    candidate_path = data_dir / candidate
                    if candidate_path.exists():
                        kwargs["line_model_path"] = candidate_path
                        break
            if "plate_length" in globals() and plate_length is not None:
                kwargs["plate_length"] = float(plate_length)
            if "plate_width" in globals() and plate_width is not None:
                kwargs["plate_width"] = float(plate_width)
            if "plate_thickness" in globals() and plate_thickness is not None:
                kwargs["plate_thickness"] = float(plate_thickness)
            if "bottom_face_mode" in globals() and bottom_face_mode:
                kwargs["bottom_face_mode"] = str(bottom_face_mode)
            if "include_hierarchies" in globals() and include_hierarchies:
                kwargs["include_hierarchies"] = include_hierarchies
            if "target_support_nodes_only" in globals() and target_support_nodes_only is not None:
                kwargs["target_support_nodes_only"] = bool(target_support_nodes_only)
            if "support_z_tolerance" in globals() and support_z_tolerance is not None:
                kwargs["support_z_tolerance"] = float(support_z_tolerance)
            if "deduplicate_support_nodes" in globals() and deduplicate_support_nodes is not None:
                kwargs["deduplicate_support_nodes"] = bool(deduplicate_support_nodes)
            if "support_node_merge_tolerance" in globals() and support_node_merge_tolerance is not None:
                kwargs["support_node_merge_tolerance"] = float(support_node_merge_tolerance)
            if "target_cluster_index" in globals() and target_cluster_index is not None:
                kwargs["target_cluster_index"] = int(target_cluster_index)
            elif "target_member_index" in globals() and target_member_index is not None:
                # Backward compatibility only: use target_cluster_index (1..4) going forward.
                kwargs["target_cluster_index"] = int(target_member_index)
                print("[GH Wrapper] target_member_index is deprecated; use target_cluster_index (1..4).")
            if "geometry_kind" in globals() and geometry_kind:
                kwargs["geometry_kind"] = str(geometry_kind)
            if "include_stiffeners" in globals() and include_stiffeners is not None:
                kwargs["include_stiffeners"] = bool(include_stiffeners)

            print("[GH Wrapper] kwargs:", kwargs)

            payload = helper.build_geometry_payload(**kwargs)
        members = payload.get("members", [])
        base_plates = payload.get("base_plates", [])
        footing_breps = payload.get("footing_breps", []) if isinstance(payload, dict) else []
        metadata = payload.get("metadata", {}) if isinstance(payload, dict) else {}
        print("[GH Wrapper] Extracted members: {0}".format(len(members)))
        print("[GH Wrapper] Extracted base_plates: {0}".format(len(base_plates)))
        if "target_cluster_index" in kwargs:
            print(
                "[GH Wrapper] target_cluster_index={0}, mode={1}".format(
                    kwargs.get("target_cluster_index"),
                    metadata.get("target_member_index_mode"),
                )
            )
            try:
                available_indices = [int((m or {}).get("index")) for m in members if isinstance(m, dict) and (m or {}).get("index") is not None]
                print("[GH Wrapper] available member indices: {0}".format(available_indices))
            except Exception:
                pass
        
        preview_breps = []
        if footing_breps:
            mm_to_doc = _mm_to_doc_scale()
            preview_breps = _scale_breps_copy(footing_breps, mm_to_doc)
            if isinstance(payload, dict):
                payload["footing_breps"] = preview_breps
            print(
                "[GH Wrapper] Built {0} footing preview breps (mm->doc scale={1})".format(
                    len(preview_breps),
                    mm_to_doc,
                )
            )
        elif hasattr(helper, "BasePlateRecord") and base_plates:
            try:
                bp_records = [helper.BasePlateRecord(**bp) for bp in base_plates]
                preview_breps = helper.build_preview_breps(bp_records)
                preview_breps = [g for g in preview_breps if g is not None]
                print("[GH Wrapper] Built {0} preview breps".format(len(preview_breps)))
            except Exception as bp_err:
                print("[GH Wrapper] Error building preview breps: {0}".format(bp_err))
                import traceback
                print(traceback.format_exc())
        
        unit_hint = ""
        if members and base_plates:
            try:
                mw = float((members[0] or {}).get("width") or 0.0)
                pl = float((base_plates[0] or {}).get("length") or 0.0)
                if mw > 0.0 and pl / mw > 20.0:
                    unit_hint = " | WARNING: plate/member scale looks too large; check mm vs m"
            except Exception:
                pass
        out = "Loaded {0} members and built {1} base plates{2}".format(len(members), len(base_plates), unit_hint)
        print("[GH Wrapper] " + out)

except Exception:
    out = traceback.format_exc()
    payload = {}
    members = []
    base_plates = []
    preview_breps = []
    print("[GH Wrapper] Exception caught:")
    print(out)
# ---------- end py3 ----------
path = FilePath(null)
bp_geometry = Python3Script(plate_thickness=Slider(0.015, range=0..1), bottom_face_mode=list, enabled=falsestart_3)  # -> out, payload, preview_breps; inputs line_model_path: String
# ---------- bp_geometry: Python ----------
"""
Grasshopper Py3 wrapper: base_plate_geometry

GH Inputs expected:
- payload_override
- line_model_path
- plate_length
- plate_width
- plate_thickness
- bottom_face_mode
- include_hierarchies
- target_support_nodes_only
- support_z_tolerance
- deduplicate_support_nodes
- support_node_merge_tolerance
- target_member_index
- target_cluster_index
- geometry_kind
- include_stiffeners
- enabled

GH Outputs:
- out
- payload
- members
- base_plates
- preview_breps
"""

import importlib.util
import os
import sys
import traceback

ROOT = r"C:\Users\Juste\Documents\_GitHub\MAS-2526\10_llhil-t2-fabrication\design\structure_model\Base_Plates"
DEFAULT_PLATE_LENGTH = 0.8
DEFAULT_PLATE_WIDTH = 0.8
DEFAULT_PLATE_THICKNESS = 0.02
RUN_TAG = "BPG_WRAPPER_SYNC_2026_05_15_A"

# Diagnostic: print resolved path
print("[GH Wrapper] RUN_TAG:", RUN_TAG)
print("[GH Wrapper] ROOT:", ROOT)
HELPER_PATH = os.path.join(ROOT, "base_plate_geometry.py")
print("[GH Wrapper] HELPER_PATH:", HELPER_PATH)
print("[GH Wrapper] HELPER_EXISTS:", os.path.exists(HELPER_PATH))



def _load_helper():
    module_name = "base_plate_geometry"
    sys.modules.pop(module_name, None)
    spec = importlib.util.spec_from_file_location(module_name, HELPER_PATH)
    if spec is None or spec.loader is None:
        raise ImportError("Could not load {0}".format(HELPER_PATH))
    module = importlib.util.module_from_spec(spec)
    # Required for dataclasses/type resolution during module execution in GH Py3.
    sys.modules[module_name] = module
    try:
        spec.loader.exec_module(module)
    except Exception as e:
        print("[GH Wrapper] Error importing base_plate_geometry.py:", e)
        import traceback
        print(traceback.format_exc())
        raise
    return module


try:
    helper = _load_helper()

    if "enabled" in globals() and enabled is False:
        print("[GH Wrapper] Branch: disabled")
        out = "Base plate geometry disabled."
        payload = {}
        members = []
        base_plates = []
        preview_breps = []
    else:
        print("[GH Wrapper] Branch: active")
        kwargs = {}
        if "payload_override" in globals() and isinstance(payload_override, dict) and payload_override:
            payload = payload_override
        else:
            kwargs = {
                "plate_length": DEFAULT_PLATE_LENGTH,
                "plate_width": DEFAULT_PLATE_WIDTH,
                "plate_thickness": DEFAULT_PLATE_THICKNESS,
                "bottom_face_mode": "Perpendicular_to_grain",
                "target_support_nodes_only": True,
                "deduplicate_support_nodes": True,
                "geometry_kind": "footing",
            }
            if "line_model_path" in globals() and line_model_path:
                from pathlib import Path
                kwargs["line_model_path"] = Path(str(line_model_path))
            else:
                # Fallback for GH context: use absolute path to repo's line_model data
                from pathlib import Path
                data_dir = Path(r"C:\Users\Juste\Documents\_GitHub\MAS-2526\10_llhil-t2-fabrication\design\line_model\data")
                # Prefer exports with known ground supports before meter-shifted variants.
                for candidate in ["0806_shifted_lines.json", "shifted_lines.json", "meters_shifted_lines.json"]:
                    candidate_path = data_dir / candidate
                    if candidate_path.exists():
                        kwargs["line_model_path"] = candidate_path
                        break
            if "plate_length" in globals() and plate_length is not None:
                kwargs["plate_length"] = float(plate_length)
            if "plate_width" in globals() and plate_width is not None:
                kwargs["plate_width"] = float(plate_width)
            if "plate_thickness" in globals() and plate_thickness is not None:
                kwargs["plate_thickness"] = float(plate_thickness)
            if "bottom_face_mode" in globals() and bottom_face_mode:
                kwargs["bottom_face_mode"] = str(bottom_face_mode)
            if "include_hierarchies" in globals() and include_hierarchies:
                kwargs["include_hierarchies"] = include_hierarchies
            if "target_support_nodes_only" in globals() and target_support_nodes_only is not None:
                kwargs["target_support_nodes_only"] = bool(target_support_nodes_only)
            if "support_z_tolerance" in globals() and support_z_tolerance is not None:
                kwargs["support_z_tolerance"] = float(support_z_tolerance)
            if "deduplicate_support_nodes" in globals() and deduplicate_support_nodes is not None:
                kwargs["deduplicate_support_nodes"] = bool(deduplicate_support_nodes)
            if "support_node_merge_tolerance" in globals() and support_node_merge_tolerance is not None:
                kwargs["support_node_merge_tolerance"] = float(support_node_merge_tolerance)
            if "target_member_index" in globals() and target_member_index is not None:
                # Backward compatibility: normalized UI uses cluster index 1..4.
                kwargs["target_cluster_index"] = int(target_member_index)
            if "target_cluster_index" in globals() and target_cluster_index is not None:
                kwargs["target_cluster_index"] = int(target_cluster_index)
            if "geometry_kind" in globals() and geometry_kind:
                kwargs["geometry_kind"] = str(geometry_kind)
            if "include_stiffeners" in globals() and include_stiffeners is not None:
                kwargs["include_stiffeners"] = bool(include_stiffeners)

            print("[GH Wrapper] kwargs:", kwargs)

            payload = helper.build_geometry_payload(**kwargs)
        members = payload.get("members", [])
        base_plates = payload.get("base_plates", [])
        footing_breps = payload.get("footing_breps", []) if isinstance(payload, dict) else []
        metadata = payload.get("metadata", {}) if isinstance(payload, dict) else {}
        print("[GH Wrapper] Extracted members: {0}".format(len(members)))
        print("[GH Wrapper] Extracted base_plates: {0}".format(len(base_plates)))
        if "target_cluster_index" in kwargs:
            print(
                "[GH Wrapper] target_cluster_index={0}, mode={1}".format(
                    kwargs.get("target_cluster_index"),
                    metadata.get("target_member_index_mode"),
                )
            )
            try:
                available_indices = [int((m or {}).get("index")) for m in members if isinstance(m, dict) and (m or {}).get("index") is not None]
                print("[GH Wrapper] available member indices: {0}".format(available_indices))
            except Exception:
                pass
        
        preview_breps = []
        if footing_breps:
            preview_breps = [g for g in footing_breps if g is not None]
            print("[GH Wrapper] Built {0} footing preview breps".format(len(preview_breps)))
        elif hasattr(helper, "BasePlateRecord") and base_plates:
            try:
                bp_records = [helper.BasePlateRecord(**bp) for bp in base_plates]
                preview_breps = helper.build_preview_breps(bp_records)
                preview_breps = [g for g in preview_breps if g is not None]
                print("[GH Wrapper] Built {0} preview breps".format(len(preview_breps)))
            except Exception as bp_err:
                print("[GH Wrapper] Error building preview breps: {0}".format(bp_err))
                import traceback
                print(traceback.format_exc())
        
        unit_hint = ""
        if members and base_plates:
            try:
                mw = float((members[0] or {}).get("width") or 0.0)
                pl = float((base_plates[0] or {}).get("length") or 0.0)
                if mw > 0.0 and pl / mw > 20.0:
                    unit_hint = " | WARNING: plate/member scale looks too large; check mm vs m"
            except Exception:
                pass
        out = "Loaded {0} members and built {1} base plates{2}".format(len(members), len(base_plates), unit_hint)
        print("[GH Wrapper] " + out)

except Exception:
    out = traceback.format_exc()
    payload = {}
    members = []
    base_plates = []
    preview_breps = []
    print("[GH Wrapper] Exception caught:")
    print(out)
# ---------- end bp_geometry ----------
dimaligned = AlignedDimension()  # -> AlignedDimension, Plane, PointA, PointB, Offset, Style
preview = CustomPreview(Geometry=py3.preview_breps, Material=ColourSwatch(SwatchColor=RGB(0, 0, 255)))
panel = Panel(py3.preview_breps)
preview_2 = CustomPreview(Geometry=bp_geometry.preview_breps, Material=ColourSwatch(SwatchColor=RGB(0, 0, 255)))
panel_2 = Panel(bp_geometry.out)
falsestart_4 = LBFalseStartToggle(False)
bp_calculations = Python3Script(
    geometry_payload=bp_geometry.payload,
    min_allowable_clearance=Slider(80, range=0..100),
    base_plate_min_thickness=Slider(0.15, range=0..1),
    bottom_face_mode=list,
    enabled=falsestart_4)  # -> out, report_text, package, pass_fail_summary, utilization_values, payload, synced_geometry_payload
# ---------- bp_calculations: Python ----------
"""
Grasshopper Py3 wrapper: base_plate_calculations

GH Inputs expected:
- geometry_payload
- bottom_face_mode
- min_allowable_clearance
- shift_step
- max_shift
- base_plate_min_thickness
- base_plate_max_thickness
- sync_plate_dimensions_from_engineering
- sync_iterations
- engineering_overrides
- enabled

GH Outputs:
- out
- payload
- report_text
- combined_report
- pass_fail_summary
- utilization_values
- synced_geometry_payload
- a
- b
- c
- d
- e
- f
- g
- h
- i
- j
- k
- l
- m
- n
"""

import importlib.util
import os
import sys
import traceback

ROOT = r"C:\Users\Juste\Documents\_GitHub\MAS-2526\10_llhil-t2-fabrication\design\structure_model\Base_Plates"
HELPER_PATH = os.path.join(ROOT, "base_plate_calculations.py")


def _load_helper():
    module_name = "base_plate_calculations"
    sys.modules.pop(module_name, None)
    spec = importlib.util.spec_from_file_location(module_name, HELPER_PATH)
    if spec is None or spec.loader is None:
        raise ImportError("Could not load {0}".format(HELPER_PATH))
    module = importlib.util.module_from_spec(spec)
    spec.loader.exec_module(module)
    return module


try:
    helper = _load_helper()

    if "enabled" in globals() and enabled is False:
        out = "Base plate calculations disabled."
        payload = {}
    else:
        if "geometry_payload" not in globals() or not geometry_payload:
            raise ValueError("geometry_payload input is required")

        kwargs = {
            "geometry_payload": geometry_payload,
            "bottom_face_mode": str(bottom_face_mode) if "bottom_face_mode" in globals() and bottom_face_mode else "Perpendicular_to_grain",
            "min_allowable_clearance": float(min_allowable_clearance) if "min_allowable_clearance" in globals() and min_allowable_clearance is not None else 80.0,
            "shift_step": float(shift_step) if "shift_step" in globals() and shift_step is not None else 10.0,
            "max_shift": float(max_shift) if "max_shift" in globals() and max_shift is not None else 400.0,
            "base_plate_min_thickness": float(base_plate_min_thickness) if "base_plate_min_thickness" in globals() and base_plate_min_thickness is not None else 10.0,
            "base_plate_max_thickness": float(base_plate_max_thickness) if "base_plate_max_thickness" in globals() and base_plate_max_thickness is not None else 60.0,
            "sync_plate_dimensions_from_engineering": bool(sync_plate_dimensions_from_engineering) if "sync_plate_dimensions_from_engineering" in globals() else True,
            "sync_iterations": int(sync_iterations) if "sync_iterations" in globals() and sync_iterations is not None else 1,
        }
        if "engineering_overrides" in globals() and engineering_overrides:
            kwargs["engineering_overrides"] = engineering_overrides

        payload = helper.run_validation(**kwargs)
        out = "Validated {0} members".format(len(payload.get("member_results", [])))

    report_text = payload.get("report_text", "") if payload else ""
    combined_report = payload.get("combined_report", "") if payload else ""
    pass_fail_summary = payload.get("pass_fail_summary", {}) if payload else {}
    utilization_values = payload.get("utilization_values", {}) if payload else {}
    synced_geometry_payload = payload.get("synced_geometry_payload", {}) if payload else {}

    a = payload.get("a") if payload else None
    b = payload.get("b") if payload else None
    c = payload.get("c") if payload else None
    d = payload.get("d") if payload else None
    e = payload.get("e") if payload else None
    f = payload.get("f") if payload else None
    g = payload.get("g") if payload else None
    h = payload.get("h") if payload else None
    i = payload.get("i") if payload else None
    j = payload.get("j") if payload else None
    k = payload.get("k") if payload else None
    l = payload.get("l") if payload else None
    m = payload.get("m") if payload else None
    n = payload.get("n") if payload else None

except Exception:
    out = traceback.format_exc()
    payload = {}
    report_text = ""
    combined_report = ""
    pass_fail_summary = {}
    utilization_values = {}
    synced_geometry_payload = {}
    a = b = c = d = e = f = g = h = i = j = k = l = m = n = None
# ---------- end bp_calculations ----------
list_2 = ValueList({"parallel_to_ground", "Perpendicular_to_grain"}, selected="parallel_to_ground")
panel_3 = Panel(bp_calculations.report_text)
panel_4 = Panel(bp_calculations.pass_fail_summary)
panel_5 = Panel(bp_calculations.utilization_values)
panel_6 = Panel(bp_calculations.package)
bp_ct_json = Python3Script(
    geometry_payload=bp_calculations.synced_geometry_payload,
    calc_payload=bp_calculations.payload,
    bottom_face_mode=list_2,
    enabled=Button())  # -> out, package, inspection_breps, json_path; inputs bottom_face_mode: String
# ---------- bp_ct_json: Python ----------
import importlib.util
import os
import sys
import traceback
from pathlib import Path

ROOT = r"C:\Users\Juste\Documents\_GitHub\MAS-2526\10_llhil-t2-fabrication\design\structure_model\Base_Plates"
HELPER_PATH = os.path.join(ROOT, "ct_anchor_milling.py")


def _load_helper():
    module_name = "ct_anchor_milling"
    sys.modules.pop(module_name, None)
    spec = importlib.util.spec_from_file_location(module_name, HELPER_PATH)
    if spec is None or spec.loader is None:
        raise ImportError("Could not load {0}".format(HELPER_PATH))
    module = importlib.util.module_from_spec(spec)
    spec.loader.exec_module(module)
    return module


try:
    helper = _load_helper()

    if "enabled" in globals() and enabled is False:
        out = "CT export disabled."
        package = {}
        records = []
        timber_model_schema = {}
        inspection_breps = []
        json_path = None
    else:
        if "geometry_payload" not in globals() or not geometry_payload:
            raise ValueError("geometry_payload input is required")
        if "calc_payload" not in globals() or not calc_payload:
            raise ValueError("calc_payload input is required")

        effective_geometry_payload = geometry_payload
        if isinstance(calc_payload, dict):
            maybe_synced = calc_payload.get("synced_geometry_payload")
            if isinstance(maybe_synced, dict) and maybe_synced:
                effective_geometry_payload = maybe_synced

        target_path = Path(str(out_json_path)) if "out_json_path" in globals() and out_json_path else (Path(ROOT) / "ct_anchor_milling_export.json")

        package = helper.export_ct_json(
            geometry_payload=effective_geometry_payload,
            calc_payload=calc_payload,
            out_json_path=target_path,
            process_only_passed=bool(process_only_passed) if "process_only_passed" in globals() else False,
        )
        records = package.get("records", [])
        timber_model_schema = package.get("timber_model_schema", {})
        inspection_breps = helper.build_inspection_breps(records)
        json_path = str(target_path)
        out = "Exported {0} CT records".format(len(records))

except Exception:
    out = traceback.format_exc()
    package = {}
    records = []
    timber_model_schema = {}
    inspection_breps = []
    json_path = None
# ---------- end bp_ct_json ----------
panel_7 = Panel(bp_ct_json.json_path)
preview_3 = CustomPreview(Geometry=bp_calculations.synced_geometry_payload, Material=ColourSwatch(SwatchColor=RGB(152, 152, 152)))
previewmat = CustomPreviewMaterials(Geometry=bp_ct_json.inspection_breps, DiffuseColor=RGB(255, 255, 255))
preview_4 = CustomPreview(Geometry=bp_ct_json.inspection_breps, Material=ColourSwatch(SwatchColor=RGB(0, 0, 0)))
