# Grasshopper definition middle_prototype_tm.ghx (Grasshopper 1.0.8)

panel = Panel("""0.06
0.08""")
unit_z = UnitZ(Factor=Slider(0.2, range=0..1))

# ---- group: ref_side_miter=False
compas_draw = COMPASDraw(cg=[null x6])  # -> rg
#   port cg: The COMPAS geometry or datastructure to be drawn.
#   port rg: The Rhino geometry object.
# ---------- compas_draw: Python ----------
# r: compas>=2.14.1
"""
Draws COMPAS geometry in Grasshopper.
"""

from typing import Any

import Grasshopper

from compas.scene import SceneObject


class CompasToRhinoGeometry(Grasshopper.Kernel.GH_ScriptInstance):
    def RunScript(self, cg):
        if not cg:
            return None

        return SceneObject(item=cg).draw()
# ---------- end compas_draw ----------

# ---- group: ref_side_miter=True / get_cutting_planes
compas_draw_2 = COMPASDraw(cg=[null x6])  # -> rg; same code as compas_draw

# ----
panel_2 = Panel("""0
1""")
panel_3 = Panel("""0,0
0,1
0,2
0,3""")

# ---- group: ref_side_miter=True / get_cut_planes_from_ref_sides
compas_draw_3 = COMPASDraw(cg=[null x6])  # -> rg; same code as compas_draw

# ----
file_path = FilePath("/Users/minghip/Desktop/")

# ---- group: Middle Node Prototype
curve = Curve([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])
curve_2 = Curve(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)
curve_3 = Curve([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])
plane = Plane(Plane(origin=(2.799809662, 1.809560759, 1.7118025), x=(0, 1, 0), y=(1, 0, 0)))
curve_4 = Curve([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])

# ----
move = Move(Geometry=plane, Motion=unit_z)  # -> Geometry, Transform

# ---- group: Middle Node Prototype (continued)
python_3_script = Python3Script(stock=panel, shoe=curve_3, primary_0=curve, primary_1=curve_4, clt_plate=curve_2, cut_plane=move.Geometry)  # -> out, timber_model; inputs stock: list of Double, shoe: list of Line, primary_0: list of Line, primary_1: list of Line, clt_plate: Polyline, cut_plane: Plane
# ---------- python_3_script: Python ----------
from compas_timber.model import TimberModel
from compas_timber.elements import Beam, Plate
from compas_timber.utils import get_polyline_normal_vector
from compas.tolerance import Tolerance
from compas_rhino.conversions import line_to_compas, plane_to_compas, polyline_to_compas
from compas.geometry import Polyline, Translation, Vector
# --------------------------------------
# Dimensions
# --------------------------------------

stock_1_width = stock[0]
stock_1_height = stock[1]

if len(stock) > 2:
    stock_2_width = stock[2]
    stock_2_height = stock[3]

# --------------------------------------
# Helpers
# --------------------------------------

def create_add_beams(model, lines, w, h, hierarchy, is_mid=True, reached = False, level=0):
    beams = []
    for line in lines:
        centerline = line_to_compas(line)
        beam = Beam.from_centerline(centerline, w, h)
        beam.name = hierarchy
        beam.attributes = {
            'hierarchy': hierarchy,
            'has_middle_joint': is_mid,
            'reached': reached,
            'level': level,
        }
        beams.append(beam)
    model.add_elements(beams)

def orientate_plane_negative(plane):
    if plane.normal.z > 0:
        plane.normal = -plane.normal
    return plane

# --------------------------------------
# Build Model
# --------------------------------------

timber_model = TimberModel(Tolerance(unit="M", absolute= 0.01))

#beams
create_add_beams(timber_model, shoe, stock_1_width, stock_1_height, "shoe", is_mid = False, reached = False, level = 0)
create_add_beams(timber_model, primary_0, stock_1_width, stock_1_height, "primary", is_mid = True, reached = False, level = 0)
create_add_beams(timber_model, primary_1, stock_1_width, stock_1_height, "primary", is_mid = True, reached = True, level = 1)

#plate
clt_polyline = polyline_to_compas(clt_plate)
clt_polyline.transform(Translation.from_vector(Vector(0,0,0.03)))
vector = get_polyline_normal_vector(clt_polyline)
if vector.z < 0:
    vector = -vector
plate = Plate.from_outline_thickness(clt_polyline, 0.1, vector)
timber_model.add_element(plate)
timber_model.attributes['clt_plate'] = plate

#plane
c_plane = plane_to_compas(cut_plane)
c_plane = orientate_plane_negative(c_plane)
timber_model.attributes['cut_plane'] = c_plane
timber_model = timber_model
# ---------- end python_3_script ----------

# ----
panel_4 = Panel(python_3_script.timber_model)
py3 = Python3Script(models=python_3_script.timber_model)  # -> out, models, planes, beams; inputs models: list
# ---------- py3: Python ----------
import os, sys, importlib

gh_dir = os.path.dirname(ghenv.Component.OnPingDocument().FilePath)

parent = os.path.dirname(gh_dir)              # go up one level
src_dir = os.path.join(parent, "src")         # go into src folder
if src_dir not in sys.path:
    sys.path.insert(0, src_dir)

import timber_config
importlib.reload(timber_config)

import timber_model
importlib.reload(timber_model)
from timber_model import apply_joints,apply_joints_middle_prototype

from copy import deepcopy

models = deepcopy(models)

for model in models:
    a, planes, beams = apply_joints_middle_prototype(model)

beams = [b.geometry for b in beams]
# ---------- end py3 ----------
compas_draw_4 = COMPASDraw(cg=py3.beams)  # -> rg; same code as compas_draw
compas_draw_5 = COMPASDraw(cg=py3.planes)  # -> rg; same code as compas_draw
tree_branch = TreeBranch(Tree=compas_draw_5, Path=panel_3, MaintainPaths=True)
py3_2 = Python3Script(models=py3.models, process=Toggle(True))  # -> out, models, debug; inputs models: list, process: Boolean
# ---------- py3_2: Python ----------
import os, sys, importlib

gh_dir = os.path.dirname(ghenv.Component.OnPingDocument().FilePath)

parent = os.path.dirname(gh_dir)              # go up one level
src_dir = os.path.join(parent, "src")         # go into src folder
if src_dir not in sys.path:
    sys.path.insert(0, src_dir)

import timber_config
importlib.reload(timber_config)

import timber_model
importlib.reload(timber_model)
from timber_model import apply_processings,apply_processings_middle_prototype

from copy import deepcopy

models = deepcopy(models)


#
if process:
    for model in models:
        model.process_joinery()
        model = apply_processings_middle_prototype(model)
# ---------- end py3_2 ----------
list_item = ListItem(List=compas_draw_4, Index=panel_2, Wrap=True)

# ----
# Preview
python_3_script_2 = Python3Script(models=py3_2.models)  # -> out, geos, colors, cut_planes, models; inputs models: list
# ---------- python_3_script_2: Python ----------
import rhinoscriptsyntax as rs
import scriptcontext as sc
import Rhino.Display as rd
import System.Drawing as sd

from compas.scene import Scene
from compas.geometry import Line, Point
from copy import deepcopy


COLORS = {
    "primary":      sd.Color.FromArgb(100, 220,  50,  50),
    "main_primary": sd.Color.FromArgb(100, 150,  80, 220),
    "secondary":    sd.Color.FromArgb(100,  50, 150, 220),
    "tertiary":     sd.Color.FromArgb(100,  80, 200, 100),
    "shoe":         sd.Color.FromArgb(100,  20, 150, 100),
    "plate":        sd.Color.FromArgb(100,  100, 100, 100)
}


geos = []
colors = []
cut_planes = []

for model in models:
    # for plate in model.plates:
    #     geos.append(plate.geometry)
    #     colors.append(COLORS['plate'])

    for beam in model.beams:
        if beam.attributes['hierarchy'] != 'shoe':
            hie = beam.attributes.get('hierarchy')

            geos.append(beam.geometry)
            colors.append(COLORS[hie])

    cut_planes.append(model.attributes['cut_plane'])
# ---------- end python_3_script_2 ----------
compas_draw_6 = COMPASDraw(cg=python_3_script_2.geos)  # -> rg; same code as compas_draw
compas_draw_7 = COMPASDraw(cg=python_3_script_2.cut_planes)  # -> rg; same code as compas_draw
preview = CustomPreview(Geometry=compas_draw_6, Material=python_3_script_2.colors)

py3_3 = Python3Script(models=py3_2.models, save=Button(), set_file_path=file_path)  # inputs models: list
# ---------- py3_3: Python ----------
import os, sys, importlib
from compas.data import json_dump
from compas_timber.fabrication import BTLxWriter

writer = BTLxWriter()

gh_dir = os.path.dirname(ghenv.Component.OnPingDocument().FilePath)
gh_par = os.path.dirname(gh_dir)
file_path = os.path.join(gh_par, "timber_design","data")

if set_file_path:
    file_path = set_file_path

if save:
    for i, model in enumerate(models):
        """Serialize models to .JSON"""
        output_path_json = os.path.join(file_path, f"1805_timber_model_{i}.json")
        output_path_btlx = os.path.join(file_path, f"1805_timber_model_{i}.btlx")
        writer.write(model, file_path=output_path_btlx)
        model.to_json(output_path_json, pretty=True)
# ---------- end py3_3 ----------
