# Grasshopper definition timber_model.ghx (Grasshopper 1.0.8)

py3 = Python3Script()  # -> out, line_model
# ---------- py3: Python ----------
from compas.data import json_load

import os, sys, importlib

gh_dir = os.path.dirname(ghenv.Component.OnPingDocument().FilePath)
gh_par = os.path.dirname(gh_dir)
file_path = os.path.join(gh_par, "line_model","data", "shifted_lines.json")
print(file_path)

line_model = json_load(file_path)
# ---------- end py3 ----------

# ----
# lines for compas_timber from graph
py3_2 = Python3Script(graph=py3.line_model)  # -> out, a, b, c, d, shoes
# ---------- py3_2: Python ----------
from compas.geometry import Line, Point
from copy import deepcopy

from compas_timber.model import TimberModel
from compas_timber.elements import Beam
from compas.tolerance import Tolerance

ng = deepcopy(graph)

#quick checking
primary_shifted = []
main_primary_shifted = []
secondary_shifted = []
tertiary_shifted = []

models = []

groups = [ng.edge_attribute(e,"group") for e in ng.edges()]

support_nodes = ng.get_support_nodes()
for s in support_nodes:
    cut_plane = ng.node_attribute(s, "cut_plane")
    print (cut_plane)
    print (ng.node_attribute(s, "group"))

for e in ng.edges():
    ln = ng.edge_attribute(e, "shifted_line")
    h = ng.edge_attribute(e, "hierarchy")
    if h == "shoe":
        # shoes.append(ln)
        """assign groups by division?"""
        pass

for i in range(1):
    model = TimberModel(Tolerance(unit="MM", absolute="0.001"))
    beams = []

    for e in ng.edges():

        h = ng.edge_attribute(e, "hierarchy")      # classification
        l = ng.edge_attribute(e, "level")          # level
        g = ng.edge_attribute(e, "group")
        w = ng.edge_attribute(e, "")

        if i == g:
            ln = ng.edge_attribute(e, "shifted_line")  # shifted geometry
            if ln is None:
                continue
            
            #assign beam cross-sections
            ln.name = h
            ln_width = 0.100
            ln_height = float

            if h == "primary":
                ln_height = ((l * .020) + 0.180)
                primary_shifted.append(ln)
            elif h == "main_primary":
                ln_height = ((l * .020) + 0.180)
                main_primary_shifted.append(ln)
            elif h == "secondary":
                ln_height = ((l * .020) + 0.120)
                secondary_shifted.append(ln)
            elif h == "tertiary":
                ln_height = ((l * .020) + 0.120)
                tertiary_shifted.append(ln)
            elif h == "shoe":
                ln_height = 0.1
                shoes.append(ln)

            beam = Beam.from_centerline(
            centerline = ln, 
            width = ln_width, 
            height = ln_height
            )

            #assign attributes to beams
            beam.name = ln.name
            beam.attributes["edge"] = e
            beam.attributes["group"] = g
            beam.attributes["level"] = l

            print (beam.attributes)
            beams.append(beam)
        
    for b in beams:
        model.add_element(b)
    
    models.append(model)

a = primary_shifted
b = secondary_shifted
c = tertiary_shifted
d = models
# ---------- end py3_2 ----------
draw = COMPASDraw(cg=py3_2.a)  # -> rg
#   port cg: The COMPAS geometry or datastructure to be drawn.
#   port rg: The Rhino geometry object.
# ---------- draw: Python ----------
# r: compas>=2.14.1
"""
Draws COMPAS geometry in Grasshopper.
"""

from typing import Any

import Grasshopper

from compas.scene import SceneObject


class CompasToRhinoGeometry(Grasshopper.Kernel.GH_ScriptInstance):
    def RunScript(self, cg):
        if not cg:
            return None

        return SceneObject(item=cg).draw()
# ---------- end draw ----------
draw_2 = COMPASDraw(cg=py3_2.c)  # -> rg; same code as draw
draw_3 = COMPASDraw(cg=py3_2.b)  # -> rg; same code as draw

panel = Panel(py3_2.d)
brep = Brep([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])
draw_4 = COMPASDraw(cg=py3_2.shoes)  # -> rg; same code as draw
md_slider = MDSlider(SliderMode=0, slider_value=Point(0.5, 0.5, 0.5), x_domain=Domain(0, 1), y_domain=Domain(0, 1), z_domain=Domain(0, 1))
crv = Curve([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])
crv_2 = Curve([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])
path = FilePath("C:\Users\frido\OneDrive\Dokumente\ETH_MAS_Architecture_Digital_Fabrication\Visual_Studio_Code\GitHub_personal\MAS_26_copy\10_T2_Timber\10_05_BTLx\")
srf = Surface(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)
crv_3 = Curve([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])
crv_4 = Curve([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])
srf_2 = Surface(reparameterize(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))
path_2 = FilePath("/Users/minghip/Desktop/")
evalsrf = EvaluateSurface(Surface=srf_2, Point=md_slider)  # -> Point, Normal, UDirection, VDirection, Frame
py3_3 = Python3Script(brep=srf, shoe=crv_3, leaf=crv, recipro=crv_2, low_sup=crv_4, path=path, b_plane=evalsrf.Frame)  # -> out, a, model, z_vectors, c, b, frames; inputs brep: list of Surface, shoe: list of Curve, leaf: list of Curve, recipro: list of Curve, low_sup: list of Curve, b_plane: Plane
# ---------- py3_3: Python ----------
from compas.scene import Scene
from compas.tolerance import Tolerance, TOL

from compas_timber.model import TimberModel
from compas_timber.elements import Beam

from compas_timber.connections import JointTopology, TMultiStepJoint, TStepJoint,LMiterJoint, TBirdsmouthJoint, XLapJoint

from compas_timber.fabrication import StepShapeType, JackRafterCut

from compas_rhino.conversions import curve_to_compas_line, surface_to_compas, plane_to_compas_frame, plane_to_compas

from compas.geometry import Frame, Plane, Vector, Point, angle_vectors, Line, intersection_segment_plane

from compas_timber.fabrication import BTLxWriter

""" check if planar function """
def is_planar(element_a, element_b):
    frames_a = []
    frames_b = []
    planarity_check = []
    frame_a = element_a.frame
    frame_a.xaxis = Vector(0,0,1)
    frames_a.append(frame_a)

    frame_b = element_b.frame
    frame_b.xaxis = Vector(0, 0, 1)

    planarity = angle_vectors(frame_a.normal, frame_b.normal, deg = True)
    planarity_check.append(planarity)

    is_planar = bool
    if planarity < 0.2 or planarity > 178.2:
        is_planar = True
    else:
        is_planar = False
    return(is_planar)

""" orient Lines, so start is on bottom"""
def orient_lines(centerline):
    if centerline.start.z > centerline.end.z:
        return Line(centerline.end, centerline.start)
    return centerline

""" get brep normalZz_vector """
z_vectors = []
for srf in brep:
    compas_srf = surface_to_compas(srf)          # returns a NurbsSurface or similar
    frame = compas_srf.frame_at(0.5, 0.5) 
    z_vector = frame.normal       # get frame at surface midpoint
    z_vectors.append(z_vector)

#initialise Scene object
scene = Scene()


#initialise compas timber model
model = TimberModel(Tolerance(unit="MM"), absolute = "100")

# beam list
beams = []

#shoes
shoes = [curve_to_compas_line(c) for c in shoe]

for l in shoes:
    beam = Beam.from_centerline(l, width = 120, height = 200, z_vector = z_vectors[0])
    beam.attributes["category"] = "shoe"
    beams.append(beam)
    model.add_element(beam)

leaves = [curve_to_compas_line(c) for c in leaf]
for l in leaves:
    beam = Beam.from_centerline(l, width = 120, height = 240)
    beam.attributes["category"] = "leaf"
    beams.append(beam)
    model.add_element(beam)

reciprocal = [curve_to_compas_line(c) for c in recipro]
for r in reciprocal:
    beam = Beam.from_centerline(r, width = 120, height = 200)
    beam.attributes["category"] = "reciprocal"
    beams.append(beam)
    model.add_element(beam)

birdmiter = [curve_to_compas_line(c) for c in low_sup]
for b in birdmiter:
    beam = Beam.from_centerline(b, width =80, height = 200)
    beam.attributes["category"] = "miterbirdsmouth"
    beams.append(beam)
    model.add_element(beam)

# print categories
for beam in model.beams:
    print(beam.attributes["category"])



model.connect_adjacent_beams(max_distance=100)
for candidate in model.joint_candidates:
    # dictionary = beam.attributes.get["category"]
    beam_a, beam_b = candidate.elements

        # sorting by Z for shoe-step-topology
    a_is_shoe = bool
    b_is_shoe = bool
    ceiling_height = 2640

    a_oriented = orient_lines(candidate.element_a.centerline) # set shoe-direction
    height_a = candidate.location.z
    # height_a = candidate.element_a.centerline.midpoint.z
    print("a", height_a)
    if height_a > ceiling_height:
        a_is_shoe = True
    else:
        a_is_shoe = False

    b_oriented = orient_lines(candidate.element_b.centerline)
    height_b = b_oriented.end.z
    print("b", height_b)
    if height_b > ceiling_height:
        b_is_shoe = True
    else:
        b_is_shoe = False

    if beam_a.attributes["category"] == "leaf" and beam_b.attributes["category"] == "shoe":
        heel_step = TStepJoint.create(model, beam_a, beam_b, step_shape="double", step_depth=40, heel_depth=60)
        # heel_step = TMultiStepJoint.create(model, beam_a, beam_b, step_shape = StepShapeType.HEEL, step_count = 2)
        # print("hello")
    elif candidate.topology == JointTopology.TOPO_X:
        lap_joint = XLapJoint.create(model, beam_a, beam_b)
    
    elif beam_a.attributes["category"] == "miterbirdsmouth" and beam_b.attributes["category"] == "reciprocal":
        birdsmouth = TBirdsmouthJoint.create(model, beam_a, beam_b)
    
    elif candidate.topology == JointTopology.TOPO_L:
        miter = LMiterJoint.create(model, candidate.element_a, candidate.element_b) #candidate.element_a as well as beam_a works!
    
    elif candidate.topology == JointTopology.TOPO_T and is_planar(candidate.element_a, candidate.element_b) == True:
        if a_is_shoe == True:
            heel = TMultiStepJoint.create(model, beam_a, beam_b, step_count = 2, step_shape = StepShapeType.HEEL)
        # elif b_is_shoe == True:
            # heelstep = heel = TMultiStepJoint.create(model, beam_a, beam_b, step_count = 2, step_shape = StepShapeType.HEEL)
        # if a_is_shoe == False:
        #     teeth = TMultiStepJoint.create(model, beam_a, beam_b, step_count = 5) #step_depth = 15
        #     print("hello")
        # elif b_is_shoe == False:
        #     teethstep = TMultiStepJoint.create(model, beam_a, beam_b, step_count = 5)
        else:
            multistep = TMultiStepJoint.create(model, beam_a, beam_b, step_count = 5)
    


#from_plane_and_beam(cls, plane, beam, ref_side_index=3, **kwargs):
frames = []
for b in beams:
    plane_cut = plane_to_compas(b_plane)
    frames.append(plane_cut)
    intersection = intersection_segment_plane(b.centerline, plane_cut, tol=None)
    if intersection is not None:
        jackrafter = JackRafterCut.from_plane_and_beam(plane_cut, b, ref_side_indes =3)
    # print(frame)
    # jackrafter = JackRafterCut.from_plane_and_beam(plane_cut, b, ref_side_indes =5)
        b.add_feature(jackrafter)


# drill_line = line_to_compas(drill_line)
# for i, beam in enumerate(model.beams):
#     if i == 0:
#         drill_feature = Drilling.from_line_and_element(drill_line, beam, diameter=10)
#         beam.add_features(drill_feature)
#         scene.add(beam.geometry)


model.process_joinery()

#visualise geometries
for beam in model.beams:
    scene.add(beam.geometry)

writer = BTLxWriter()
btlx = writer.write(model, file_path=path)

a = scene.draw()
# ---------- end py3_3 ----------
file_path = FilePath("/Users/minghip/Desktop/timber_model_0.json")
python_3_script = Python3Script(y=file_path)  # -> out, a; inputs y: String
# ---------- python_3_script: Python ----------
from compas.data import json_load
from compas_timber.model import TimberModel

timber_model = json_load(y)
timber_model.process_joinery()
a = timber_model
# ---------- end python_3_script ----------
draw_5 = COMPASDraw(cg=py3_3.frames)  # -> rg; same code as draw
draw_6 = COMPASDraw(cg=py3_3.z_vectors)  # -> rg; same code as draw
panel_2 = Panel(python_3_script.a)
number_slider = Slider(0, range=0..3)
path_3 = FilePath("/Users/minghip/Desktop/")

deconstruct_brep = DeconstructBrep(Brep=brep)  # -> Faces, Edges, Vertices
join_curves = JoinCurves(Curves=deconstruct_brep.Edges, Preserve=False)  # -> flatten(Curves)
curve = Curve(join_curves)
offset = OffsetCurve(Curve=curve, Distance=Slider(0, range=0..1), Corners=1)
unit_z = UnitZ(Factor="0.05")

# ---- group: boxes
python_3_script_2 = Python3Script(x=flatten(curve), y=flatten(offset))  # -> out, boxes, x_sorted, y_sorted, c_pts; inputs x: list of Curve, y: list of Curve
# ---------- python_3_script_2: Python ----------
from compas.geometry import bounding_box, Box
from compas_rhino.conversions import curve_to_compas_polyline

def curve_xy_key(curve):
    c = curve_to_compas_polyline(curve)
    pts = c.points
    bb = bounding_box(pts)

    # center of bounding box
    cx = (bb[0][0] + bb[6][0]) * 0.5
    cy = (bb[0][1] + bb[6][1]) * 0.5

    # return (cx, cy)
    return (round(cy, 3), cx)

# sort first
x_sorted = sorted(x, key=curve_xy_key)
y_sorted = sorted(y, key=curve_xy_key)

boxes = []
for curve in y_sorted:
    c = curve_to_compas_polyline(curve)
    points = c.points
    a = Box.from_bounding_box(bounding_box(points))
    a.zsize = 20.0
    boxes.append(a)

c_pts = [b.frame.point for b in boxes]
print(boxes)
# ---------- end python_3_script_2 ----------

# ----
move = Move(Geometry=python_3_script_2.x_sorted, Motion=unit_z)  # -> Geometry, Transform
draw_7 = COMPASDraw(cg=python_3_script_2.c_pts)  # -> rg; same code as draw
point_list = PointList(Points=draw_7, Size=Slider(1, range=0..10))

timber_model = Python3Script(line_graph=py3.line_model, boxes=python_3_script_2.boxes, clt_plates=move.Geometry)  # -> out, a, b, c, d, e, processed_models; inputs boxes: list, clt_plates: list of Polyline
# ---------- timber_model: Python ----------
import os, sys, importlib

gh_dir = os.path.dirname(ghenv.Component.OnPingDocument().FilePath)
if gh_dir not in sys.path:
    sys.path.insert(0, gh_dir)

import timber_helpers
importlib.reload(timber_helpers)

from timber_helpers import is_planar, orient_polyline_to_world_z

from compas.scene import Scene
from compas_rhino.conversions import line_to_compas, polyline_to_compas, plane_to_compas
from compas.tolerance import Tolerance, TOL

from compas_timber.model import TimberModel
from compas_timber.elements import Beam, Plate
from compas_timber.analyzers import TripletAnalyzer

from compas_timber.connections import JointTopology
from compas_timber.connections import TMultiStepJoint
from compas_timber.connections import TStepJoint
from compas_timber.connections import LMiterJoint
from compas_timber.connections import TBirdsmouthJoint
from compas_timber.connections import XLapJoint
from compas_timber.connections import KBirdsmouthJoint

from compas_timber.fabrication import JackRafterCut

from compas.geometry import Frame, Vector, Point, angle_vectors, centroid_points, Line, intersection_segment_plane

#initialise scene object
scene = Scene()

models = []

# ============================================================
# Create CLT Plates
# ============================================================

plates = []

# for c in clt_plates:
#     compas_poly = polyline_to_compas(c)
#     if compas_poly is None:
#         continue

#     center = centroid_points(compas_poly.points)    
#     for b in boxes:
#         model = TimberModel(Tolerance(unit="MM", absolute="0.001"))
#         if b.contains_point(center):
#             compas_poly, local_z = oriented_polyline_to_world_z(compas_poly)

#             plate = Plate.from_outline_thickness(
#                 compas_poly,
#                 thickness=0.1,
#                 vector=local_z
#             )

#             plates.append(plate)
#             model.add_element(plate)
#             base_model.add_element(plate)
#             models.append(model)

# ============================================================
# Input Beams
# ============================================================

from copy import deepcopy

ng = deepcopy(line_graph)

groups = [ng.edge_attribute(e,"group") for e in ng.edges()]

support_nodes = ng.get_support_nodes()
for s in support_nodes:
    cut_plane = ng.node_attribute(s, "cut_plane")
    print (ng.node_attribute(s, "group"))

for e in ng.edges():
    ln = ng.edge_attribute(e, "shifted_line")
    h = ng.edge_attribute(e, "hierarchy")
    if h == "shoe":
        # shoes.append(ln)
        """assign groups by division?"""
        pass

for i in range(1):
    model = TimberModel(Tolerance(unit="MM", absolute="0.001"))
    beams = []

    for e in ng.edges():

        h = ng.edge_attribute(e, "hierarchy")      # classification
        l = ng.edge_attribute(e, "level")          # level
        g = ng.edge_attribute(e, "group")
        w = ng.edge_attribute(e, "")

        if i == g:
            ln = ng.edge_attribute(e, "shifted_line")  # shifted geometry
            if ln is None:
                continue
            
            #assign beam cross-sections
            ln.name = h
            ln_width = 0.100
            ln_height = float

            if h == "primary":
                ln_height = ((l * .020) + 0.120)
            elif h == "main_primary":
                ln_height = ((l * .020) + 0.120)
            elif h == "secondary":
                ln_height = ((l * .020) + 0.100)
            elif h == "tertiary":
                ln_height = ((l * .020) + 0.100)
            elif h == "shoe":
                ln_height = 0.1

            beam = Beam.from_centerline(
            centerline = ln, 
            width = ln_width, 
            height = ln_height
            )

            #assign attributes to beams
            beam.name = ln.name
            beam.attributes["edge"] = e
            beam.attributes["group"] = g
            beam.attributes["level"] = l

            print (beam.attributes)
            beams.append(beam)
        
    for b in beams:
        model.add_element(b)
    
    models.append(model)

# ============================================================
# Process Jointery
# ============================================================

distances = []
max_distance = 0.001

#reset beams and features
for model in models:
    for beam in model.beams:
        beam.remove_features()

    #compute line network
    model.connect_adjacent_beams(max_distance)

    for c in model.joint_candidates:
        distances.append(c.distance)

    #handle non-pair joints (in this case a 3-way connection using TripletAnalyzer)
    analyzer = TripletAnalyzer(model, max(distances)/5)
    clusters = analyzer.find()

    for cluster in clusters:
        if cluster.topology == JointTopology.TOPO_K:
            print ("k joint found!")
            reordered_elements = [e for e in cluster.elements if h == "primary"]
            print (len(reordered_elements))
            reordered_elements += [e for e in cluster.elements if e not in reordered_elements]
            kbj = KBirdsmouthJoint.promote_cluster(model, cluster[0], reordered_elements=reordered_elements, mill_depth=.040)

    #set joint conditions
    for candidate in model.joint_candidates:
        if candidate.is_promoted == False:
            #check for mid_point = above certain z_height
            b_is_shoe = bool

            ceiling_height = 3.9
            height_b = candidate.element_b.centerline.midpoint.z

            if height_b > ceiling_height:
                b_is_shoe = True
            else:
                b_is_shoe = False

            #joints based on topology
            if candidate.topology == JointTopology.TOPO_T and is_planar(candidate.element_a, candidate.element_b) == False:
                if b_is_shoe == True:
                    t_step_joint = TMultiStepJoint.create(model, candidate.element_a, candidate.element_b, step_count=2)
                else:
                    if angle_vectors(candidate.element_a.centerline.direction, candidate.element_b.centerline.direction, deg=True) < 50:
                        step_shape = "heel"
                    else:
                        step_shape = "step"
                    t_step_joint = TMultiStepJoint.create(model, candidate.element_a, candidate.element_b, step_shape=step_shape, step_depth=.02, riser_angle=90)
            
            elif candidate.topology == JointTopology.TOPO_T and is_planar(candidate.element_a, candidate.element_b) == True:
                t_bm_joint = TBirdsmouthJoint.create(model, candidate.element_a, candidate.element_b)
                # t_np_step_joint = TMultiStepJoint.create(model, candidate.element_a, candidate.element_b, do_refine_cut=True, step_depth = 0.02, riser_angle=90)
            elif candidate.topology==JointTopology.TOPO_L:
                mp = Frame.worldYZ
                l_miter_joint = LMiterJoint.create(model, candidate.element_a, candidate.element_b, cutoff = False)

            elif candidate.topology == JointTopology.TOPO_X:
                x_lap_joint = XLapJoint.create(model, candidate.element_a, candidate.element_b)

            else:
                continue
    
    # #add features to beams
    # for beam in model.beams:
    #     if beam.name == "primary":
    #         for plane in cutting_frames:
    #             intersection = intersection_segment_plane(b.centerline, plane, tol=None)
    #             if intersection is not None:
    #                 jackrafter = JackRafterCut.from_plane_and_beam(plane, b, ref_side_indes =3)
    #         # jackrafter = JackRafterCut.from_plane_and_beam(plane_cut, b, ref_side_indes =5)
    #             b.add_feature(jackrafter)


    # drill_line = line_to_compas(drill_line)
    # for i, beam in enumerate(model.beams):
    #     if i == 0:
    #         drill_feature = Drilling.from_line_and_element(drill_line, beam, diameter=10)
    #         beam.add_features(drill_feature)
    #         scene.add(beam.geometry)

    #process joints in compas timber model
    model.process_joinery()

processed_models = []

for m in models:
    processed_models.append(m)

    #visualise geometries
    for beam in (m.beams):
        scene.add(beam.geometry)
    
    for plate in (m.plates):
        scene.add(plate.geometry)
    print ("ADDED")

a = scene.draw()
# ---------- end timber_model ----------
panel_3 = Panel(timber_model.processed_models)
compas_draw = COMPASDraw(cg=timber_model.d)  # -> rg; same code as draw
compas_draw_2 = COMPASDraw(cg=timber_model.b)  # -> rg; same code as draw
timber_model_2 = Python3Script(boxes=python_3_script_2.boxes, clt_plates=move.Geometry)  # -> out, a, b, c, d, e, processed_models, base_model; inputs boxes: list, clt_plates: list of Polyline
# ---------- timber_model_2: Python ----------
from compas.scene import Scene
from compas_rhino.conversions import line_to_compas, polyline_to_compas, plane_to_compas
from compas.tolerance import Tolerance, TOL

from compas_timber.model import TimberModel
from compas_timber.elements import Beam, Plate
from compas_timber.analyzers import TripletAnalyzer

from compas_timber.connections import JointTopology
from compas_timber.connections import TMultiStepJoint
from compas_timber.connections import TStepJoint
from compas_timber.connections import LMiterJoint
from compas_timber.connections import TBirdsmouthJoint
from compas_timber.connections import XLapJoint
from compas_timber.connections import KBirdsmouthJoint

from compas_timber.fabrication import JackRafterCut

from compas.geometry import Frame, Vector, Point, angle_vectors, centroid_points, Line, intersection_segment_plane

#initialise scene object
scene = Scene()

# #initialise base compas timber model
# base_model = TimberModel(Tolerance(unit="MM", absolute="0.001"))

# ============================================================
# Helper: make polygon point order consistent with world Z+
# ============================================================
def oriented_polyline_to_world_z_plus(compas_poly):
    pts = list(compas_poly.points)

    if len(pts) < 3:
        return compas_poly, Vector(0, 0, 1)

    # remove duplicate last point if closed
    if pts[0] == pts[-1]:
        pts = pts[:-1]

    if len(pts) < 3:
        return compas_poly, Vector(0, 0, 1)

    p0 = pts[0]
    p1 = pts[1]
    p2 = pts[2]

    frame = Frame.from_points(p0, p1, p2)
    local_z = frame.zaxis
    world_z = Vector(0, 0, 1)

    # if normal points downward, reverse point order
    if local_z.dot(world_z) < 0:
        pts.reverse()

        # close it again if original was closed
        pts.append(pts[0])

        compas_poly = type(compas_poly)(pts)

        p0 = compas_poly.points[0]
        p1 = compas_poly.points[1]
        p2 = compas_poly.points[2]

        frame = Frame.from_points(p0, p1, p2)
        local_z = frame.zaxis

    return compas_poly, local_z

# ============================================================
# Create CLT Plates
# ============================================================

plates = []
models = []

# for c in clt_plates:
#     compas_poly = polyline_to_compas(c)
#     if compas_poly is None:
#         continue
#     center = centroid_points(compas_poly.points)    
#     for b in boxes:
#         model = TimberModel(Tolerance(unit="MM", absolute="0.001"))
#         if b.contains_point(center):
#             compas_poly, local_z = oriented_polyline_to_world_z_plus(compas_poly)

#             plate = Plate.from_outline_thickness(
#                 compas_poly,
#                 thickness=0.1,
#                 vector=local_z
#             )

#             plates.append(plate)
#             model.add_element(plate)
#             base_model.add_element(plate)
#             models.append(model)

# ============================================================
# Input Beams
# ============================================================

beams = []
cutting_frames = []
for plane in footing_plane:
    cutting_frames.append(plane)

#convert rhino curves into compas lines
"""to be replaced with graph input"""

from copy import deepcopy

ng = deepcopy(line_graph)

for edge in ng.edges():
    h = ng.edge_attribute(edge,"hierarchy") #primary, secondary, tertiary
    l = ng.edge_attribute(edge,"level") #0,1,2... top to bottom 
    g = ng.edge_attribute(edge, "group") #quadrant 0,1,2,3 clockwise

    """set width and height based on attributes"""

    if h == "primary" and l != 0:
        ln_width = 0.100
        ln_height = 0.160
    elif h == "primary" or h == "secondary":
        ln_width = 0.100
        ln_height = 0.120
    elif h == "tertiary":
        ln_width = 0.100
        ln_height = 0.120

    ln = ng.edge_attribute(edge, "shifted_line")
    
    if ln is None:
        continue
    
    # for b, m in zip (boxes, models):
    #     if b.contains_point(ln.start) or b.contains_point(ln.end):
    #         ln.name = h
    #         beam = Beam.from_centerline(ln,width=ln_width, height=ln_height)
    #         beam.name = ln.name
    #         beams.append(beam)
    #         m.add_element(beam)
    #         base_model.add_element(beam)
    #         break



#temporary add shoe
for shoe in shoes:
    shoe_line = line_to_compas(shoe)
    for b, m in zip (boxes, models):
        if b.contains_point(shoe_line.start) or b.contains_point(shoe_line.end):
            beam = Beam.from_centerline(shoe_line, width=0.1, height=0.1)
            beam.name = "shoe"
            beams.append(beam)
            m.add_element(beam)
            base_model.add_element(beam)

# ============================================================
# Process Jointery
# ============================================================

#planarity check
def is_planar(element_a, element_b):
    frames_a = []
    frames_b = []
    planarity_check = []
    frame_a = element_a.frame
    frame_a.xaxis = Vector(0,0,1)
    frames_a.append(frame_a)

    frame_b = element_b.frame
    frame_b.xaxis = Vector(0, 0, 1)

    planarity = angle_vectors(frame_a.normal, frame_b.normal, deg = True)
    planarity_check.append(planarity)

    is_planar = bool
    if planarity < 0.2 or planarity > 178.2:
        is_planar = True
    else:
        is_planar = False
    return(is_planar)

distances = []

#reset beams and features
for model in models:
    for beam in model.beams:
        beam.remove_features()

    #compute line network
    base_model.connect_adjacent_beams(max_distance)
    model.connect_adjacent_beams(max_distance)

    for c in model.joint_candidates:
        distances.append(c.distance)

    # #handle non-pair joints (in this case a 3-way connection using TripletAnalyzer)
    # analyzer = TripletAnalyzer(model, max(distances)/2)
    # clusters = analyzer.find()

    # for cluster in clusters:
    #     if cluster.topology == JointTopology.TOPO_K:
    #         reordered_elements = [e for e in cluster.elements if h == "primary"]
    #         print (len(reordered_elements))
    #         reordered_elements += [e for e in cluster.elements if e not in reordered_elements]
    #         kbj = KBirdsmouthJoint.promote_cluster(model, cluster[0], reordered_elements=reordered_elements, mill_depth=.040)

    #debugging tools
    candidates_a = []
    candidates_b = []
    frames_a = []
    frames_b = []
    planarity_check = []

    #set joint conditions
    for candidate in model.joint_candidates:
        if candidate.is_promoted == False:
            #check for mid_point = above certain z_height
            a_is_shoe = bool
            b_is_shoe = bool
            ceiling_height = 3.9

            height_a = candidate.element_a.centerline.midpoint.z
            if height_a > ceiling_height:
                a_is_shoe = True
            else:
                a_is_shoe = False
                
            height_b = candidate.element_b.centerline.midpoint.z
            if height_b > ceiling_height:
                b_is_shoe = True
            else:
                b_is_shoe = False

            #joints based on topology, planarity and z height
            if candidate.topology == JointTopology.TOPO_T and is_planar(candidate.element_a, candidate.element_b) == True:
                if b_is_shoe == True:
                    t_step_joint = TMultiStepJoint.create(model, candidate.element_a, candidate.element_b, step_count=2)
                
                else:
                    if angle_vectors(candidate.element_a.centerline.direction, candidate.element_b.centerline.direction, deg=True) < 50:
                        step_shape = "heel"
                    else:
                        step_shape = "step"
                    
                    print (candidate.element_a.centerline.name)
                    t_step_joint = TMultiStepJoint.create(model, candidate.element_a, candidate.element_b, step_shape=step_shape, step_depth=.02, riser_angle=90)
            
            elif candidate.topology == JointTopology.TOPO_T and is_planar(candidate.element_a, candidate.element_b) == False:
                t_bm_joint = TBirdsmouthJoint.create(model, candidate.element_a, candidate.element_b)
                # t_np_step_joint = TMultiStepJoint.create(model, candidate.element_a, candidate.element_b, do_refine_cut=True, step_depth = 0.02, riser_angle=90)
            elif candidate.topology==JointTopology.TOPO_L:
                mp = Frame.worldYZ
                # miter_plane = ??
                l_miter_joint = LMiterJoint.create(model, candidate.element_a, candidate.element_b, cutoff = False)

            elif candidate.topology == JointTopology.TOPO_X:
                x_lap_joint = XLapJoint.create(model, candidate.element_a, candidate.element_b)

            else:
                continue
    
    # #add features to beams
    # for beam in model.beams:
    #     if beam.name == "primary":
    #         for plane in cutting_frames:
    #             intersection = intersection_segment_plane(b.centerline, plane, tol=None)
    #             if intersection is not None:
    #                 jackrafter = JackRafterCut.from_plane_and_beam(plane, b, ref_side_indes =3)
    #         # jackrafter = JackRafterCut.from_plane_and_beam(plane_cut, b, ref_side_indes =5)
    #             b.add_feature(jackrafter)


    # drill_line = line_to_compas(drill_line)
    # for i, beam in enumerate(model.beams):
    #     if i == 0:
    #         drill_feature = Drilling.from_line_and_element(drill_line, beam, diameter=10)
    #         beam.add_features(drill_feature)
    #         scene.add(beam.geometry)

    #process joints in compas timber model
    model.process_joinery()

processed_models = []

for m in models:
    processed_models.append(m)

    #visualise geometries
    for beam in (m.beams):
        scene.add(beam.geometry)
    
    for plate in (m.plates):
        scene.add(plate.geometry)
    print ("ADDED")

a = scene.draw()
# ---------- end timber_model_2 ----------
panel_4 = Panel(timber_model_2.base_model)
panel_5 = Panel(timber_model_2.processed_models)
compas_draw_3 = COMPASDraw(cg=timber_model.e)  # -> rg; same code as draw
compas_draw_4 = COMPASDraw(cg=timber_model.c)  # -> rg; same code as draw
displayjointnames = Python3Script(model=timber_model.processed_models)
# ---------- displayjointnames: Python ----------
import Grasshopper
import System

from compas_rhino.conversions import point_to_rhino

from compas_timber.utils import intersection_line_line_param

class ShowJointTypes(Grasshopper.Kernel.GH_ScriptInstance):
    def RunScript(self, model):
        self.pt = []
        self.txt = []

        for joint in model.joints:
            line_a, line_b = joint.elements[0].centerline, joint.elements[1].centerline
            [p1, _], [p2, _] = intersection_line_line_param(line_a, line_b, float("inf"), False, 1e-3)
            p1 = point_to_rhino(p1)
            p2 = point_to_rhino(p2)
            
            self.pt.append((p2 + p1)/2)
            self.txt.append(joint.__class__.__name__)
    
    def DrawViewportWires(self, arg):
        if ghenv.Component.Locked:
            return
        col = System.Drawing.Color.FromArgb(255, 0, 0, 0)
        # https://developer.rhino3d.com/api/RhinoCommon/html/M_Rhino_Display_DisplayPipeline_Draw2dText_5.htm
        for p, t in zip(self.pt, self.txt):
            arg.Display.Draw2dText(t, col, p, True, 25, "Verdana")
# ---------- end displayjointnames ----------
geometry = Geometry(timber_model.a)
compas_draw_5 = COMPASDraw(cg=timber_model_2.b)  # -> rg; same code as draw
compas_draw_6 = COMPASDraw(cg=timber_model_2.d)  # -> rg; same code as draw
compas_draw_7 = COMPASDraw(cg=timber_model_2.c)  # -> rg; same code as draw
compas_draw_8 = COMPASDraw(cg=timber_model_2.e)  # -> rg; same code as draw
py3_4 = Python3Script(models=timber_model.processed_models, save=Button(), file_path=path_2)  # -> out, a; inputs models: list
# ---------- py3_4: Python ----------
import os
from compas.data import json_dump

if save:
    for i, m in enumerate(models):
        """Serialize models to .JSON"""
        output_path = os.path.join(file_path, f"timber_model_{i}.json")
        m.to_json(output_path, pretty=True)
        print(f"Model written to {output_path}")
# ---------- end py3_4 ----------
panel_6 = Panel(py3_4.out)
list_item = ListItem(List=timber_model_2.processed_models, Index=0, Wrap=True)
geometry_2 = Geometry(timber_model_2.a)
displayjointnames_2 = Python3Script(model=list_item)  # same code as displayjointnames
item = ListItem(List=timber_model_2.processed_models, Index="0", Wrap=True)
panel_7 = Panel(item)

# ---- group: json_dump of n modules
py3_5 = Python3Script(x=item, save=Button(), file_path=path_3)  # -> out, a; inputs x: list
# ---------- py3_5: Python ----------
import os
from compas.data import json_dump

if save:
    for i, m in enumerate(x):
        """Serialize models to .JSON"""
        output_path = os.path.join(file_path, f"timber_model_{i}.json")
        m.to_json(output_path, pretty=True)
        print(f"Model written to {output_path}")
# ---------- end py3_5 ----------

# ---- group: visualize modules based on index
py3_6 = Python3Script(x=item, y=number_slider)  # -> out, a; inputs x: list, y: Int32
# ---------- py3_6: Python ----------
from compas.scene import Scene
from compas_rhino.conversions import line_to_compas
from compas.tolerance import Tolerance, TOL

from compas_timber.model import TimberModel
from compas_timber.elements import Beam, Plate

from compas_timber.connections import JointTopology
from compas_timber.connections import TMultiStepJoint
from compas_timber.connections import TStepJoint
from compas_timber.connections import LMiterJoint
from compas_timber.connections import TBirdsmouthJoint
from compas_timber.connections import XLapJoint

from compas_rhino.conversions import line_to_compas, polyline_to_compas

from compas.geometry import Frame, Vector, Point, angle_vectors, centroid_points

from statistics import mean


scene = Scene()
# for m in x:
# model = x[y]
for beam in (x[y].beams):
    if not beam.attributes["neighbour"]:
        scene.add(beam.geometry)

for plate in (x[y].plates):
    scene.add(plate.geometry)
a = scene.draw()
# ---------- end py3_6 ----------

# ---- group: visualize neighbour beams based on module index
py3_7 = Python3Script(x=item, y=number_slider)  # -> out, a; inputs x: list, y: Int32
# ---------- py3_7: Python ----------
from compas.scene import Scene
from compas_rhino.conversions import line_to_compas
from compas.tolerance import Tolerance, TOL

from compas_timber.model import TimberModel
from compas_timber.elements import Beam, Plate

from compas_timber.connections import JointTopology
from compas_timber.connections import TMultiStepJoint
from compas_timber.connections import TStepJoint
from compas_timber.connections import LMiterJoint
from compas_timber.connections import TBirdsmouthJoint
from compas_timber.connections import XLapJoint

from compas_rhino.conversions import line_to_compas, polyline_to_compas

from compas.geometry import Frame, Vector, Point, angle_vectors, centroid_points

from statistics import mean


scene = Scene()
# for m in x:
# model = x[y]
for beam in (x[y].beams):
    if beam.attributes["neighbour"]:
        scene.add(beam.geometry)
a = scene.draw()
# ---------- end py3_7 ----------
